# Dynamo custom node createThirdTiao.dyf (Dynamo 0.9.1.4062)
# category: Geometry.Solid
# 创建第三跳

# group: Inputs
h_10 = Input(h_10 : double = 64.0)  # h of ManGong
b_04 = Input(b_04 : double = 70.0)  # b of SanDou/JiaohuDou
h_04 = Input(h_04 : double = 45.0)  # h of SanDou/JiaohuDou
h1_04 = Input(h1_04 : double = 17.0)  # h1 of SanDou/JiaohuDou
h2_05 = Input(h2_05 :double = 0.0)  # h2 of JiaohuDou
b1_04 = Input(b1_04 : double = 46.0)  # b1 of SanDou
JSC_D5_1 = Input(JSC_D5_1 : Surface)  # Juansha Curve direction 5
b2_01 = Input(b2_01 : double = 40.0)  # b2 of LuDou
b2_04 = Input(b2_04 : double = 40.0)  # b2 of SanDou/JiaohuDou
h2_04 = Input(h2_04 : double = 18.0)  # h2 of SanDou
b1_10 = Input(b1_10 : double = 60.0)  # b1 of ManGong
b2_12 = Input(b2_12 : double = 92.0)  # b2 of ShuaTou
m = Input(m : int = 4)  # Number of Juansha
h1_10 = Input(h1_10 : double = 32.0)  # h1 of ManGong
b_12 = Input(b_12 : double = 632.0)  # b of ShuaTou
b_1 = Input(b_1 : double = 256.0)  # b of LingGong
t_08 = Input(t_08 : double = 40.0)  # t of HuaGong
JSC_D3_1 = Input(JSC_D3_1 : Surface)  # Juansha Curve direction 3
b_10 = Input(b_10 : double = 413.0)  # b of ManGong
b_07 = Input(b_07 : double = 220.0)  # b of GuaziGong
JSC_D4_1 = Input(JSC_D4_1 : Surface)  # Juansha Curve direction 4
JSC_D1_1 = Input(JSC_D1_1 : Surface)  # Juansha Curve direction 1
JSC_D2_1 = Input(JSC_D2_1 : Surface)  # Juansha Curve direction 2

code_block = CodeBlock(h=h_04, h1=h1_04) { h - h1; }
string = StringInput("y")
code_block_2 = CodeBlock(b=b_04, b1=b1_04) { (b - b1) / 2; }
number = DoubleInput(0)
number_2 = DoubleInput(1)
pointAtParameter = Surface.PointAtParameter(surface=JSC_D5_1, u=number, v=number_2)
x_draft = CodeBlock(b=b1_04) { b / 2; }
code_block_3 = CodeBlock(x=x_draft) { -x; }
y_draft = CodeBlock(b=b2_01) { b / 2; }
translate = Geometry.Translate(geometry=pointAtParameter, xTranslation=code_block_3, yTranslation=y_draft)
code_block_4 = CodeBlock(b1=b1_04) { b1 / 2; }
createQuad = Custom[createQuad](p=translate, radius=code_block_4)  # 创建四边形面 p->面的中心点 r->面的边长 z->面的位置z值
byPatch = Surface.ByPatch(createQuad)
number_3 = DoubleInput(1)
number_4 = DoubleInput(0.5)
pointAtParameter_2 = Surface.PointAtParameter(surface=byPatch, u=number_3, v=number_4)
string_2 = StringInput("x+")
createTrape = Custom[createTrape](d=code_block_2, d1=b1_04, p=pointAtParameter_2, h=h1_04, d2=b_04, direction=string_2)  # 创建梯形平面 p->短边中心点 d1->短边边长 d2->长边边长 h->高 d->倾斜进深 direc->倾斜方向
byPatch_2 = Surface.ByPatch(createTrape)
number_5 = DoubleInput(0)
number_6 = DoubleInput(0.5)
pointAtParameter_3 = Surface.PointAtParameter(surface=byPatch_2, u=number_5, v=number_6)
createUPlane = Custom[createUPlane](w=b_04, h1=code_block, h2=h2_05, direction=string, p=pointAtParameter_3, w1=b2_04)  # 创建枓U型侧面 p->底边中心定位点 w->长边长 w1->顶部短边长 h1->高（h - h1) h2->中间U型部分高 direc->绘制方向
byPatch_3 = Surface.ByPatch(createUPlane)
code_block_5 = CodeBlock(h=h_04, h1=h1_04) { h - h1; }
code_block_6 = CodeBlock(h2=h2_04, h1=code_block_5) { h2 / h1; }
code_block_7 = CodeBlock(b=b_04, b2=b2_04) { ((b - b2) / 2) + b2; }
code_block_8 = CodeBlock(w1=code_block_7, w=b_04) { w1 / w; }
pointAtParameter_4 = Surface.PointAtParameter(surface=byPatch_3, u=code_block_6, v=code_block_8)
code_block_9 = CodeBlock(b2=b2_12, b1=b1_10, b_04=b_04, w1_04=code_block_7) { b2 - b1 - (b_04 - w1_04); }
string_3 = StringInput("x+")
createJuanshaCurve = Custom[createJuanshaCurve](h=h_10, p=pointAtParameter_4, b1=b1_10, b2=code_block_9, m=m, h1=h1_10, direction=string_3)  # 创建卷杀曲线 p->定位点 b1->卷杀部分长 b2->其余部分长 m->卷杀段数 h1->卷杀部分高 h->整体高 direc->方向
code_block_10 = CodeBlock(w1=code_block_7, w=b_04) { 1 - w1 / w; }
pointAtParameter_5 = Surface.PointAtParameter(surface=byPatch_3, u=code_block_6, v=code_block_10)
createJuanshaCurve_2 = Custom[createJuanshaCurve](h=h_10, p=pointAtParameter_5, b1=b1_10, b2=code_block_9, m=m, h1=h1_10, direction=string_3)
join = List.Join(createJuanshaCurve, createJuanshaCurve_2)
byLoft = PolySurface.ByLoft(join)
surfaces = PolySurface.Surfaces(byLoft)
number_7 = DoubleInput(7)
getItemAtIndex = List.GetItemAtIndex(list=surfaces, index=number_7)
perimeterCurves = Surface.PerimeterCurves(getItemAtIndex)
byJoinedCurves = PolyCurve.ByJoinedCurves(perimeterCurves)
number_8 = DoubleInput(0)
getItemAtIndex_2 = List.GetItemAtIndex(list=perimeterCurves, index=number_8)
code_block_11 = CodeBlock(b=b_12, b1=b1_10, d=code_block_9) { b - b1 - d; }
string_4 = StringInput("x-")
createCubiod = Custom[createCubiod](cur=getItemAtIndex_2, width=code_block_11, direction=string_4)  # 创建单卷杀长方体栱部分， cur->边界曲线 width->长方体长度 direction->延伸方向
number_9 = DoubleInput(1)
getItemAtIndex_3 = List.GetItemAtIndex(list=perimeterCurves, index=number_9)
createCubiod_2 = Custom[createCubiod](cur=getItemAtIndex_3, width=code_block_11, direction=string_4)
number_10 = DoubleInput(2)
getItemAtIndex_4 = List.GetItemAtIndex(list=perimeterCurves, index=number_10)
createCubiod_3 = Custom[createCubiod](cur=getItemAtIndex_4, width=code_block_11, direction=string_4)
number_11 = DoubleInput(3)
getItemAtIndex_5 = List.GetItemAtIndex(list=perimeterCurves, index=number_11)
createCubiod_4 = Custom[createCubiod](cur=getItemAtIndex_5, width=code_block_11, direction=string_4)
join_2 = List.Join(createCubiod, createCubiod_2, createCubiod_3, createCubiod_4)
byJoinedCurves_2 = PolyCurve.ByJoinedCurves(join_2)
join_3 = List.Join(byJoinedCurves, byJoinedCurves_2)
byLoft_2 = Solid.ByLoft(join_3)
string_5 = StringInput("x")
number_12 = DoubleInput(0.5)
number_13 = DoubleInput(0)
pointAtParameter_6 = Surface.PointAtParameter(surface=byPatch, u=number_12, v=number_13)
string_6 = StringInput("y-")
createTrape_2 = Custom[createTrape](d=code_block_2, d1=b1_04, p=pointAtParameter_6, h=h1_04, d2=b_04, direction=string_6)
byPatch_4 = Surface.ByPatch(createTrape_2)
number_14 = DoubleInput(0.5)
number_15 = DoubleInput(0)
pointAtParameter_7 = Surface.PointAtParameter(surface=byPatch_4, u=number_14, v=number_15)
createUPlane_2 = Custom[createUPlane](w=b_04, h1=code_block, h2=h2_04, direction=string_5, p=pointAtParameter_7, w1=b2_04)
byPatch_5 = Surface.ByPatch(createUPlane_2)
pointAtParameter_8 = Surface.PointAtParameter(surface=byPatch_5, u=code_block_6, v=code_block_8)
code_block_12 = CodeBlock(b=b_04, b1=b1_04) { (b - b1) / 2; }
code_block_13 = CodeBlock(b=b_1, b1=b1_10, t_08=t_08, d_04=code_block_12) { ((b - 2 * b1) - t_08 - 2 * d_04) / 2; }
string_7 = StringInput("y-")
createJuanshaCurve_3 = Custom[createJuanshaCurve](h=h_10, p=pointAtParameter_8, b1=b1_10, b2=code_block_13, m=m, h1=h1_10, direction=string_7)
pointAtParameter_9 = Surface.PointAtParameter(surface=byPatch_5, u=code_block_6, v=code_block_10)
createJuanshaCurve_4 = Custom[createJuanshaCurve](h=h_10, p=pointAtParameter_9, b1=b1_10, b2=code_block_13, m=m, h1=h1_10, direction=string_7)
join_4 = List.Join(createJuanshaCurve_3, createJuanshaCurve_4)
byLoft_3 = PolySurface.ByLoft(join_4)
surfaces_2 = PolySurface.Surfaces(byLoft_3)
number_16 = DoubleInput(7)
getItemAtIndex_6 = List.GetItemAtIndex(list=surfaces_2, index=number_16)
perimeterCurves_2 = Surface.PerimeterCurves(getItemAtIndex_6)
byJoinedCurves_3 = PolyCurve.ByJoinedCurves(perimeterCurves_2)
number_17 = DoubleInput(0.5)
number_18 = DoubleInput(1)
pointAtParameter_10 = Surface.PointAtParameter(surface=byPatch, u=number_17, v=number_18)
string_8 = StringInput("y+")
createTrape_3 = Custom[createTrape](d=code_block_2, d1=b1_04, p=pointAtParameter_10, h=h1_04, d2=b_04, direction=string_8)
byPatch_6 = Surface.ByPatch(createTrape_3)
number_19 = DoubleInput(0.5)
number_20 = DoubleInput(1)
pointAtParameter_11 = Surface.PointAtParameter(surface=byPatch_6, u=number_19, v=number_20)
createUPlane_3 = Custom[createUPlane](w=b_04, h1=code_block, h2=h2_04, direction=string_5, p=pointAtParameter_11, w1=b2_04)
byPatch_7 = Surface.ByPatch(createUPlane_3)
pointAtParameter_12 = Surface.PointAtParameter(surface=byPatch_7, u=code_block_6, v=code_block_8)
string_9 = StringInput("y+")
createJuanshaCurve_5 = Custom[createJuanshaCurve](h=h_10, p=pointAtParameter_12, b1=b1_10, b2=code_block_13, m=m, h1=h1_10, direction=string_9)
pointAtParameter_13 = Surface.PointAtParameter(surface=byPatch_7, u=code_block_6, v=code_block_10)
createJuanshaCurve_6 = Custom[createJuanshaCurve](h=h_10, p=pointAtParameter_13, b1=b1_10, b2=code_block_13, m=m, h1=h1_10, direction=string_9)
join_5 = List.Join(createJuanshaCurve_5, createJuanshaCurve_6)
byLoft_4 = PolySurface.ByLoft(join_5)
surfaces_3 = PolySurface.Surfaces(byLoft_4)
number_21 = DoubleInput(7)
getItemAtIndex_7 = List.GetItemAtIndex(list=surfaces_3, index=number_21)
perimeterCurves_3 = Surface.PerimeterCurves(getItemAtIndex_7)
byJoinedCurves_4 = PolyCurve.ByJoinedCurves(perimeterCurves_3)
join_6 = List.Join(byJoinedCurves_3, byJoinedCurves_4)
byLoft_5 = PolySurface.ByLoft(join_6)
string_10 = StringInput("x")
number_22 = DoubleInput(0)
number_23 = DoubleInput(1)
pointAtParameter_14 = Surface.PointAtParameter(surface=JSC_D3_1, u=number_22, v=number_23)
x_draft_2 = CodeBlock(b=b1_04) { b / 2; }
code_block_14 = CodeBlock(x=x_draft_2) { -x; }
y_draft_2 = CodeBlock(b=b2_01) { b / 2; }
translate_2 = Geometry.Translate(geometry=pointAtParameter_14, xTranslation=code_block_14, yTranslation=y_draft_2)
code_block_15 = CodeBlock(b1=b1_04) { b1 / 2; }
createQuad_2 = Custom[createQuad](p=translate_2, radius=code_block_15)
byPatch_8 = Surface.ByPatch(createQuad_2)
number_24 = DoubleInput(0.5)
number_25 = DoubleInput(0)
pointAtParameter_15 = Surface.PointAtParameter(surface=byPatch_8, u=number_24, v=number_25)
string_11 = StringInput("y-")
createTrape_4 = Custom[createTrape](d=code_block_12, d1=b1_04, p=pointAtParameter_15, h=h1_04, d2=b_04, direction=string_11)
byPatch_9 = Surface.ByPatch(createTrape_4)
number_26 = DoubleInput(0.5)
number_27 = DoubleInput(0)
pointAtParameter_16 = Surface.PointAtParameter(surface=byPatch_9, u=number_26, v=number_27)
createUPlane_4 = Custom[createUPlane](w=b_04, h1=code_block_5, h2=h2_04, direction=string_10, p=pointAtParameter_16, w1=b2_04)
byPatch_10 = Surface.ByPatch(createUPlane_4)
pointAtParameter_17 = Surface.PointAtParameter(surface=byPatch_10, u=code_block_6, v=code_block_8)
code_block_16 = CodeBlock(b=b_10, b1=b1_10, b_07=b_07, d_04=code_block_12) { ((b - 2 * b1) - b_07 - 2 * d_04) / 2; }
string_12 = StringInput("y-")
createJuanshaCurve_7 = Custom[createJuanshaCurve](h=h_10, p=pointAtParameter_17, b1=b1_10, b2=code_block_16, m=m, h1=h1_10, direction=string_12)
pointAtParameter_18 = Surface.PointAtParameter(surface=byPatch_10, u=code_block_6, v=code_block_10)
createJuanshaCurve_8 = Custom[createJuanshaCurve](h=h_10, p=pointAtParameter_18, b1=b1_10, b2=code_block_16, m=m, h1=h1_10, direction=string_12)
join_7 = List.Join(createJuanshaCurve_7, createJuanshaCurve_8)
byLoft_6 = PolySurface.ByLoft(join_7)
surfaces_4 = PolySurface.Surfaces(byLoft_6)
number_28 = DoubleInput(7)
getItemAtIndex_8 = List.GetItemAtIndex(list=surfaces_4, index=number_28)
perimeterCurves_4 = Surface.PerimeterCurves(getItemAtIndex_8)
byJoinedCurves_5 = PolyCurve.ByJoinedCurves(perimeterCurves_4)
code_block_17 = CodeBlock(h=h_04, h1=h1_04) { h - h1; }
string_13 = StringInput("x")
code_block_18 = CodeBlock(b=b_04, b1=b1_04) { (b - b1) / 2; }
number_29 = DoubleInput(0)
number_30 = DoubleInput(1)
pointAtParameter_19 = Surface.PointAtParameter(surface=JSC_D4_1, u=number_29, v=number_30)
x_draft_3 = CodeBlock(b=b1_04) { b / 2; }
code_block_19 = CodeBlock(x=x_draft_3) { -x; }
y_draft_3 = CodeBlock(b=b2_01) { b / 2; }
translate_3 = Geometry.Translate(geometry=pointAtParameter_19, xTranslation=code_block_19, yTranslation=y_draft_3)
code_block_20 = CodeBlock(b1=b1_04) { b1 / 2; }
createQuad_3 = Custom[createQuad](p=translate_3, radius=code_block_20)
byPatch_11 = Surface.ByPatch(createQuad_3)
number_31 = DoubleInput(0.5)
number_32 = DoubleInput(1)
pointAtParameter_20 = Surface.PointAtParameter(surface=byPatch_11, u=number_31, v=number_32)
string_14 = StringInput("y+")
createTrape_5 = Custom[createTrape](d=code_block_18, d1=b1_04, p=pointAtParameter_20, h=h1_04, d2=b_04, direction=string_14)
byPatch_12 = Surface.ByPatch(createTrape_5)
number_33 = DoubleInput(0.5)
number_34 = DoubleInput(1)
pointAtParameter_21 = Surface.PointAtParameter(surface=byPatch_12, u=number_33, v=number_34)
createUPlane_5 = Custom[createUPlane](w=b_04, h1=code_block_17, h2=h2_04, direction=string_13, p=pointAtParameter_21, w1=b2_04)
byPatch_13 = Surface.ByPatch(createUPlane_5)
pointAtParameter_22 = Surface.PointAtParameter(surface=byPatch_13, u=code_block_6, v=code_block_8)
string_15 = StringInput("y+")
createJuanshaCurve_9 = Custom[createJuanshaCurve](h=h_10, p=pointAtParameter_22, b1=b1_10, b2=code_block_16, m=m, h1=h1_10, direction=string_15)
pointAtParameter_23 = Surface.PointAtParameter(surface=byPatch_13, u=code_block_6, v=code_block_10)
createJuanshaCurve_10 = Custom[createJuanshaCurve](h=h_10, p=pointAtParameter_23, b1=b1_10, b2=code_block_16, m=m, h1=h1_10, direction=string_15)
join_8 = List.Join(createJuanshaCurve_9, createJuanshaCurve_10)
byLoft_7 = PolySurface.ByLoft(join_8)
surfaces_5 = PolySurface.Surfaces(byLoft_7)
number_35 = DoubleInput(7)
getItemAtIndex_9 = List.GetItemAtIndex(list=surfaces_5, index=number_35)
perimeterCurves_5 = Surface.PerimeterCurves(getItemAtIndex_9)
byJoinedCurves_6 = PolyCurve.ByJoinedCurves(perimeterCurves_5)
join_9 = List.Join(byJoinedCurves_5, byJoinedCurves_6)
byLoft_8 = PolySurface.ByLoft(join_9)
byPatch_14 = Surface.ByPatch(createJuanshaCurve_7)
byPatch_15 = Surface.ByPatch(createJuanshaCurve_8)
byPatch_16 = Surface.ByPatch(createJuanshaCurve_9)
byPatch_17 = Surface.ByPatch(createJuanshaCurve_10)
byPatch_18 = Surface.ByPatch(createJuanshaCurve_4)
byPatch_19 = Surface.ByPatch(createJuanshaCurve_3)
byPatch_20 = Surface.ByPatch(createJuanshaCurve_5)
byPatch_21 = Surface.ByPatch(createJuanshaCurve_6)
byPatch_22 = Surface.ByPatch(createJuanshaCurve)
byPatch_23 = Surface.ByPatch(createJuanshaCurve_2)
code_block_21 = CodeBlock(h=h_04, h1=h1_04) { h - h1; }
string_16 = StringInput("x")
code_block_22 = CodeBlock(b=b_04, b1=b1_04) { (b - b1) / 2; }
number_36 = DoubleInput(1)
number_37 = DoubleInput(0)
pointAtParameter_24 = Surface.PointAtParameter(surface=JSC_D1_1, u=number_36, v=number_37)
x_draft_4 = CodeBlock(b=b2_01) { b / 2; }
y_draft_4 = CodeBlock(b=b1_04) { b / 2; }
translate_4 = Geometry.Translate(geometry=pointAtParameter_24, xTranslation=x_draft_4, yTranslation=y_draft_4)
code_block_23 = CodeBlock(b1=b1_04) { b1 / 2; }
createQuad_4 = Custom[createQuad](p=translate_4, radius=code_block_23)
byPatch_24 = Surface.ByPatch(createQuad_4)
number_38 = DoubleInput(0.5)
number_39 = DoubleInput(0)
pointAtParameter_25 = Surface.PointAtParameter(surface=byPatch_24, u=number_38, v=number_39)
string_17 = StringInput("y-")
createTrape_6 = Custom[createTrape](d=code_block_22, d1=b1_04, p=pointAtParameter_25, h=h1_04, d2=b_04, direction=string_17)
byPatch_25 = Surface.ByPatch(createTrape_6)
number_40 = DoubleInput(0.5)
number_41 = DoubleInput(0)
pointAtParameter_26 = Surface.PointAtParameter(surface=byPatch_25, u=number_40, v=number_41)
createUPlane_6 = Custom[createUPlane](w=b_04, h1=code_block_21, h2=h2_04, direction=string_16, p=pointAtParameter_26, w1=b2_04)
byPatch_26 = Surface.ByPatch(createUPlane_6)
number_42 = DoubleInput(0.5)
number_43 = DoubleInput(1)
pointAtParameter_27 = Surface.PointAtParameter(surface=byPatch_24, u=number_42, v=number_43)
string_18 = StringInput("y+")
createTrape_7 = Custom[createTrape](d=code_block_22, d1=b1_04, p=pointAtParameter_27, h=h1_04, d2=b_04, direction=string_18)
byPatch_27 = Surface.ByPatch(createTrape_7)
number_44 = DoubleInput(0.5)
number_45 = DoubleInput(1)
pointAtParameter_28 = Surface.PointAtParameter(surface=byPatch_27, u=number_44, v=number_45)
createUPlane_7 = Custom[createUPlane](w=b_04, h1=code_block_21, h2=h2_04, direction=string_16, p=pointAtParameter_28, w1=b2_04)
byPatch_28 = Surface.ByPatch(createUPlane_7)
string_19 = StringInput("y")
number_46 = DoubleInput(1)
number_47 = DoubleInput(0.5)
pointAtParameter_29 = Surface.PointAtParameter(surface=byPatch_24, u=number_46, v=number_47)
string_20 = StringInput("x+")
createTrape_8 = Custom[createTrape](d=code_block_22, d1=b1_04, p=pointAtParameter_29, h=h1_04, d2=b_04, direction=string_20)
byPatch_29 = Surface.ByPatch(createTrape_8)
number_48 = DoubleInput(0)
number_49 = DoubleInput(0.5)
pointAtParameter_30 = Surface.PointAtParameter(surface=byPatch_29, u=number_48, v=number_49)
createUPlane_8 = Custom[createUPlane](w=b_04, h1=code_block_21, h2=h2_05, direction=string_19, p=pointAtParameter_30, w1=b2_04)
byPatch_30 = Surface.ByPatch(createUPlane_8)
number_50 = DoubleInput(0)
number_51 = DoubleInput(0.5)
pointAtParameter_31 = Surface.PointAtParameter(surface=byPatch_24, u=number_50, v=number_51)
string_21 = StringInput("x-")
createTrape_9 = Custom[createTrape](d=code_block_22, d1=b1_04, p=pointAtParameter_31, h=h1_04, d2=b_04, direction=string_21)
byPatch_31 = Surface.ByPatch(createTrape_9)
number_52 = DoubleInput(0)
number_53 = DoubleInput(0.5)
pointAtParameter_32 = Surface.PointAtParameter(surface=byPatch_31, u=number_52, v=number_53)
createUPlane_9 = Custom[createUPlane](w=b_04, h1=code_block_21, h2=h2_05, direction=string_19, p=pointAtParameter_32, w1=b2_04)
byPatch_32 = Surface.ByPatch(createUPlane_9)
code_block_24 = CodeBlock(h=h_04, h1=h1_04) { h - h1; }
string_22 = StringInput("x")
code_block_25 = CodeBlock(b=b_04, b1=b1_04) { (b - b1) / 2; }
number_54 = DoubleInput(0)
number_55 = DoubleInput(1)
pointAtParameter_33 = Surface.PointAtParameter(surface=JSC_D2_1, u=number_54, v=number_55)
x_draft_5 = CodeBlock(b=b2_01) { b / 2; }
y_draft_5 = CodeBlock(b=b1_04) { b / 2; }
code_block_26 = CodeBlock(y=y_draft_5) { -y; }
translate_5 = Geometry.Translate(geometry=pointAtParameter_33, xTranslation=x_draft_5, yTranslation=code_block_26)
code_block_27 = CodeBlock(b1=b1_04) { b1 / 2; }
createQuad_5 = Custom[createQuad](p=translate_5, radius=code_block_27)
byPatch_33 = Surface.ByPatch(createQuad_5)
number_56 = DoubleInput(0.5)
number_57 = DoubleInput(0)
pointAtParameter_34 = Surface.PointAtParameter(surface=byPatch_33, u=number_56, v=number_57)
string_23 = StringInput("y-")
createTrape_10 = Custom[createTrape](d=code_block_25, d1=b1_04, p=pointAtParameter_34, h=h1_04, d2=b_04, direction=string_23)
byPatch_34 = Surface.ByPatch(createTrape_10)
number_58 = DoubleInput(0.5)
number_59 = DoubleInput(0)
pointAtParameter_35 = Surface.PointAtParameter(surface=byPatch_34, u=number_58, v=number_59)
createUPlane_10 = Custom[createUPlane](w=b_04, h1=code_block_24, h2=h2_04, direction=string_22, p=pointAtParameter_35, w1=b2_04)
byPatch_35 = Surface.ByPatch(createUPlane_10)
number_60 = DoubleInput(0.5)
number_61 = DoubleInput(1)
pointAtParameter_36 = Surface.PointAtParameter(surface=byPatch_33, u=number_60, v=number_61)
string_24 = StringInput("y+")
createTrape_11 = Custom[createTrape](d=code_block_25, d1=b1_04, p=pointAtParameter_36, h=h1_04, d2=b_04, direction=string_24)
byPatch_36 = Surface.ByPatch(createTrape_11)
number_62 = DoubleInput(0.5)
number_63 = DoubleInput(1)
pointAtParameter_37 = Surface.PointAtParameter(surface=byPatch_36, u=number_62, v=number_63)
createUPlane_11 = Custom[createUPlane](w=b_04, h1=code_block_24, h2=h2_04, direction=string_22, p=pointAtParameter_37, w1=b2_04)
byPatch_37 = Surface.ByPatch(createUPlane_11)
string_25 = StringInput("y")
number_64 = DoubleInput(1)
number_65 = DoubleInput(0.5)
pointAtParameter_38 = Surface.PointAtParameter(surface=byPatch_33, u=number_64, v=number_65)
string_26 = StringInput("x+")
createTrape_12 = Custom[createTrape](d=code_block_25, d1=b1_04, p=pointAtParameter_38, h=h1_04, d2=b_04, direction=string_26)
byPatch_38 = Surface.ByPatch(createTrape_12)
number_66 = DoubleInput(0)
number_67 = DoubleInput(0.5)
pointAtParameter_39 = Surface.PointAtParameter(surface=byPatch_38, u=number_66, v=number_67)
createUPlane_12 = Custom[createUPlane](w=b_04, h1=code_block_24, h2=h2_05, direction=string_25, p=pointAtParameter_39, w1=b2_04)
byPatch_39 = Surface.ByPatch(createUPlane_12)
number_68 = DoubleInput(0)
number_69 = DoubleInput(0.5)
pointAtParameter_40 = Surface.PointAtParameter(surface=byPatch_33, u=number_68, v=number_69)
string_27 = StringInput("x-")
createTrape_13 = Custom[createTrape](d=code_block_25, d1=b1_04, p=pointAtParameter_40, h=h1_04, d2=b_04, direction=string_27)
byPatch_40 = Surface.ByPatch(createTrape_13)
number_70 = DoubleInput(0)
number_71 = DoubleInput(0.5)
pointAtParameter_41 = Surface.PointAtParameter(surface=byPatch_40, u=number_70, v=number_71)
createUPlane_13 = Custom[createUPlane](w=b_04, h1=code_block_24, h2=h2_05, direction=string_25, p=pointAtParameter_41, w1=b2_04)
byPatch_41 = Surface.ByPatch(createUPlane_13)
number_72 = DoubleInput(0.5)
number_73 = DoubleInput(1)
pointAtParameter_42 = Surface.PointAtParameter(surface=byPatch_8, u=number_72, v=number_73)
string_28 = StringInput("y+")
createTrape_14 = Custom[createTrape](d=code_block_12, d1=b1_04, p=pointAtParameter_42, h=h1_04, d2=b_04, direction=string_28)
byPatch_42 = Surface.ByPatch(createTrape_14)
number_74 = DoubleInput(0.5)
number_75 = DoubleInput(1)
pointAtParameter_43 = Surface.PointAtParameter(surface=byPatch_42, u=number_74, v=number_75)
createUPlane_14 = Custom[createUPlane](w=b_04, h1=code_block_5, h2=h2_04, direction=string_10, p=pointAtParameter_43, w1=b2_04)
byPatch_43 = Surface.ByPatch(createUPlane_14)
string_29 = StringInput("y")
number_76 = DoubleInput(1)
number_77 = DoubleInput(0.5)
pointAtParameter_44 = Surface.PointAtParameter(surface=byPatch_8, u=number_76, v=number_77)
string_30 = StringInput("x+")
createTrape_15 = Custom[createTrape](d=code_block_12, d1=b1_04, p=pointAtParameter_44, h=h1_04, d2=b_04, direction=string_30)
byPatch_44 = Surface.ByPatch(createTrape_15)
number_78 = DoubleInput(0)
number_79 = DoubleInput(0.5)
pointAtParameter_45 = Surface.PointAtParameter(surface=byPatch_44, u=number_78, v=number_79)
createUPlane_15 = Custom[createUPlane](w=b_04, h1=code_block_5, h2=h2_05, direction=string_29, p=pointAtParameter_45, w1=b2_04)
byPatch_45 = Surface.ByPatch(createUPlane_15)
number_80 = DoubleInput(0)
number_81 = DoubleInput(0.5)
pointAtParameter_46 = Surface.PointAtParameter(surface=byPatch_8, u=number_80, v=number_81)
string_31 = StringInput("x-")
createTrape_16 = Custom[createTrape](d=code_block_12, d1=b1_04, p=pointAtParameter_46, h=h1_04, d2=b_04, direction=string_31)
byPatch_46 = Surface.ByPatch(createTrape_16)
number_82 = DoubleInput(0)
number_83 = DoubleInput(0.5)
pointAtParameter_47 = Surface.PointAtParameter(surface=byPatch_46, u=number_82, v=number_83)
createUPlane_16 = Custom[createUPlane](w=b_04, h1=code_block_5, h2=h2_05, direction=string_29, p=pointAtParameter_47, w1=b2_04)
byPatch_47 = Surface.ByPatch(createUPlane_16)
number_84 = DoubleInput(0.5)
number_85 = DoubleInput(0)
pointAtParameter_48 = Surface.PointAtParameter(surface=byPatch_11, u=number_84, v=number_85)
string_32 = StringInput("y-")
createTrape_17 = Custom[createTrape](d=code_block_18, d1=b1_04, p=pointAtParameter_48, h=h1_04, d2=b_04, direction=string_32)
byPatch_48 = Surface.ByPatch(createTrape_17)
number_86 = DoubleInput(0.5)
number_87 = DoubleInput(0)
pointAtParameter_49 = Surface.PointAtParameter(surface=byPatch_48, u=number_86, v=number_87)
createUPlane_17 = Custom[createUPlane](w=b_04, h1=code_block_17, h2=h2_04, direction=string_13, p=pointAtParameter_49, w1=b2_04)
byPatch_49 = Surface.ByPatch(createUPlane_17)
string_33 = StringInput("y")
number_88 = DoubleInput(1)
number_89 = DoubleInput(0.5)
pointAtParameter_50 = Surface.PointAtParameter(surface=byPatch_11, u=number_88, v=number_89)
string_34 = StringInput("x+")
createTrape_18 = Custom[createTrape](d=code_block_18, d1=b1_04, p=pointAtParameter_50, h=h1_04, d2=b_04, direction=string_34)
byPatch_50 = Surface.ByPatch(createTrape_18)
number_90 = DoubleInput(0)
number_91 = DoubleInput(0.5)
pointAtParameter_51 = Surface.PointAtParameter(surface=byPatch_50, u=number_90, v=number_91)
createUPlane_18 = Custom[createUPlane](w=b_04, h1=code_block_17, h2=h2_05, direction=string_33, p=pointAtParameter_51, w1=b2_04)
byPatch_51 = Surface.ByPatch(createUPlane_18)
number_92 = DoubleInput(0)
number_93 = DoubleInput(0.5)
pointAtParameter_52 = Surface.PointAtParameter(surface=byPatch_11, u=number_92, v=number_93)
string_35 = StringInput("x-")
createTrape_19 = Custom[createTrape](d=code_block_18, d1=b1_04, p=pointAtParameter_52, h=h1_04, d2=b_04, direction=string_35)
byPatch_52 = Surface.ByPatch(createTrape_19)
number_94 = DoubleInput(0)
number_95 = DoubleInput(0.5)
pointAtParameter_53 = Surface.PointAtParameter(surface=byPatch_52, u=number_94, v=number_95)
createUPlane_19 = Custom[createUPlane](w=b_04, h1=code_block_17, h2=h2_05, direction=string_33, p=pointAtParameter_53, w1=b2_04)
byPatch_53 = Surface.ByPatch(createUPlane_19)
number_96 = DoubleInput(0)
number_97 = DoubleInput(0.5)
pointAtParameter_54 = Surface.PointAtParameter(surface=byPatch, u=number_96, v=number_97)
string_36 = StringInput("x-")
createTrape_20 = Custom[createTrape](d=code_block_2, d1=b1_04, p=pointAtParameter_54, h=h1_04, d2=b_04, direction=string_36)
byPatch_54 = Surface.ByPatch(createTrape_20)
number_98 = DoubleInput(0)
number_99 = DoubleInput(0.5)
pointAtParameter_55 = Surface.PointAtParameter(surface=byPatch_54, u=number_98, v=number_99)
createUPlane_20 = Custom[createUPlane](w=b_04, h1=code_block, h2=h2_05, direction=string, p=pointAtParameter_55, w1=b2_04)
byPatch_55 = Surface.ByPatch(createUPlane_20)

# group: Outputs
ST_Cuboid = Output(byLoft_2)
LG_Cuboid = Output(byLoft_5)
MG_Cuboid = Output(byLoft_8)
JS1_C1 = Output(byPatch_14)
JS1_C2 = Output(byPatch_15)
JS1_S = Output(byLoft_6)
JS2_C1 = Output(byPatch_16)
JS2_S = Output(byLoft_7)
JS2_C2 = Output(byPatch_17)
JS3_C2 = Output(byPatch_18)
JS3_C1 = Output(byPatch_19)
JS3_S = Output(byLoft_3)
JS4_C1 = Output(byPatch_20)
JS4_S = Output(byLoft_4)
JS4_C2 = Output(byPatch_21)
JS5_C1 = Output(byPatch_22)
JS5_S = Output(byLoft)
JS5_C2 = Output(byPatch_23)
SD1_U1 = Output(byPatch_26)
SD1_U2 = Output(byPatch_28)
SD1_U3 = Output(byPatch_30)
SD1_U4 = Output(byPatch_32)
SD2_U1 = Output(byPatch_35)
SD2_U2 = Output(byPatch_37)
SD2_U3 = Output(byPatch_39)
SD2_U4 = Output(byPatch_41)
SD3_U1 = Output(byPatch_10)
SD3_U2 = Output(byPatch_43)
SD3_U3 = Output(byPatch_45)
SD3_U4 = Output(byPatch_47)
SD4_U1 = Output(byPatch_49)
SD4_U2 = Output(byPatch_13)
SD4_U3 = Output(byPatch_51)
SD4_U4 = Output(byPatch_53)
JHD_U2 = Output(byPatch_7)
JHD_U1 = Output(byPatch_5)
JHD_U3 = Output(byPatch_3)
JHD_U4 = Output(byPatch_55)
SD1_T1 = Output(byPatch_25)
SD1_T2 = Output(byPatch_27)
SD1_T3 = Output(byPatch_29)
SD1_T4 = Output(byPatch_31)
SD2_T1 = Output(byPatch_34)
SD2_T2 = Output(byPatch_36)
SD2_T4 = Output(byPatch_40)
SD2_T3 = Output(byPatch_38)
SD3_T1 = Output(byPatch_9)
SD3_T2 = Output(byPatch_42)
SD3_T4 = Output(byPatch_46)
SD3_T3 = Output(byPatch_44)
SD4_T1 = Output(byPatch_48)
SD4_T2 = Output(byPatch_12)
SD4_T3 = Output(byPatch_50)
SD4_T4 = Output(byPatch_52)
JHD_T1 = Output(byPatch_4)
JHD_T2 = Output(byPatch_6)
JHD_T3 = Output(byPatch_2)
JHD_T4 = Output(byPatch_54)
SD1_Q = Output(byPatch_24)
SD2_q = Output(byPatch_33)
SD3_Q = Output(byPatch_8)
SD4_Q = Output(byPatch_11)
JHD_Q = Output(byPatch)
