# Dynamo graph draw.dyn (Dynamo 0.9.1.4062)

# group: 创建最底面
code_block = CodeBlock()
# ---------- code_block.designscript (46 lines) ----------
//创建四边形面
//p->面的中心点
//r->面的边长
//z->面的位置z值
def createQuadCenter(p, r)
{
 // .p1----.p2
 // |  |
 // | p |
 // |  |
 // |  |
 // .p4----.p3
 x1 = p.X - r;
 y1 = p.Y - r;
 z1 = p.Z;

 //test=p.X;

 x2 = p.X + r;
 y2 = p.Y - r;
 z2 = p.Z;

 x3 = p.X + r;
 y3 = p.Y + r;
 z3 = p.Z;

 x4 = p.X - r;
 y4 = p.Y + r;
 z4 = p.Z;

 p1 = Point.ByCoordinates(x1, y1, z1);
 p2 = Point.ByCoordinates(x2, y2, z2);
 p3 = Point.ByCoordinates(x3, y3, z3);
 p4 = Point.ByCoordinates(x4, y4, z4);

 poly = Polygon.ByPoints({p1, p2, p3, p4});

 //l1 = List.FirstItem(p1);
 //l1 = List.AddItemToEnd(p2);
 //l1 = List.AddItemToEnd(p3);
 //l1 = List.AddItemToEnd(p4);

 //sur = Surface.ByPatch(ploy);

 return = poly;
};
# ----------------------------------------
number = DoubleInput(0)
number_2 = DoubleInput(0)
number_3 = DoubleInput(0)
byCoordinates = Point.ByCoordinates(x=number, y=number_2, z=number_3)
n01_b1 = DoubleInput(100)  # "01-b1"
code_block_2 = CodeBlock(b1=n01_b1) { b1 / 2; }
code_block_3 = CodeBlock(p=byCoordinates, r=code_block_2) { createQuadCenter(p, r); }
byPatch = Surface.ByPatch(code_block_3)

# group: 创建镜像平面（备用）
number_4 = DoubleInput(0.5)
number_5 = DoubleInput(0.5)
pointAtParameter = Surface.PointAtParameter(u=number_4, v=number_5)
code_block_4 = CodeBlock()
# ---------- code_block_4.designscript (73 lines) ----------
//创建镜像平面
//p->镜像平面底边中心点
//direc->镜像方向
//r->边长
//if中的变量需要提前初始化
def createMirrorPlane(p, direc, r)
{
 x1 = 0;
 x2 = 0;
 x3 = 0;
 x4 = 0;
 y1 = 0;
 y2 = 0;
 y3 = 0;
 y4 = 0;
 z1 = 0;
 z2 = 0;
 z3 = 0;
 z4 = 0;
 geometry = [Imperative]
 {
  if(direc == "x")
  {

   x1 = p.X - r / 2;
   y1 = p.Y;
   z1 = p.Z;

   x2 = p.X + r / 2;
   y2 = p.Y;
   z2 = p.Z;

   x3 = p.X + r / 2;
   y3 = p.Y;
   z3 = p.Z + r;

   x4 = p.X - r / 2;
   y4 = p.Y;
   z4 = p.Z + r;


  }
  if(direc == "y")
  {
   x1 = p.X;
   y1 = p.Y - r / 2;
   z1 = p.Z;

   x2 = p.X;
   y2 = p.Y + r / 2;
   z2 = p.Z;

   x3 = p.X;
   y3 = p.Y + r / 2;
   z3 = p.Z + r;

   x4 = p.X;
   y4 = p.Y - r / 2;
   z4 = p.Z + r;


  }
 }

 p1 = Point.ByCoordinates(x1, y1, z1);
 p2 = Point.ByCoordinates(x2, y2, z2);
 p3 = Point.ByCoordinates(x3, y3, z3);
 p4 = Point.ByCoordinates(x4, y4, z4);

 poly = Polygon.ByPoints({p1, p2, p3, p4});

 return = poly;
};
# ----------------------------------------
string = StringInput("x")
code_block_5 = CodeBlock { r; }
code_block_6 = CodeBlock(direction=string, r=code_block_5) { createMirrorPlane(center, direction, r); }
code_block_7 = CodeBlock()
# ---------- code_block_7.designscript (34 lines) ----------
def createJuanshaPath(p, d, direc)
{

 x1 = 0;
 y1 = 0;
 z1 = 0;
 x2 = 0;
 y2 = 0;
 z2 = 0;

 geometry = [Imperative]
 {
  if(direc == "x")
  {
   x1 = p.X;
   y1 = p.Y;
   z1 = p.Z;

   x2 = p.X + d;
   y2 = p.Y;
   z2 = p.Z;

  }
 }

 p1 = Point.ByCoordinates(x1, y1, z1);
 p2 = Point.ByCoordinates(x2, y2, z2);

 poly = Polygon.ByPoints({p1, p2});

 curve = PolygonCurve.ByPoints({p1, p2}, false);

 return = poly;
};
# ----------------------------------------

watch = Watch()

# group: 创建栌枓四个倾斜梯形面
number_6 = DoubleInput(0.5)
number_7 = DoubleInput(0)
pointAtParameter_2 = Surface.PointAtParameter(surface=byPatch, u=number_6, v=number_7)
code_block_8 = CodeBlock(d1=n01_b1) { d1; }
n01_b = DoubleInput(120)  # "01-b"
n01_h1 = DoubleInput(30)  # "01-h1"
code_block_9 = CodeBlock(b=n01_b, b1=n01_b1) { (b - b1) / 2; }
string_2 = StringInput("y-")
code_block_10 = CodeBlock(center=pointAtParameter_2, d1=code_block_8, d2=n01_b, h=n01_h1, dy=code_block_9, direction=string_2) { createTrape(center, d1, d2, h ,dy, direction); }
byPatch_2 = Surface.ByPatch(code_block_10)
number_8 = DoubleInput(0.5)
number_9 = DoubleInput(1)
pointAtParameter_3 = Surface.PointAtParameter(surface=byPatch, u=number_8, v=number_9)
string_3 = StringInput("y+")
code_block_11 = CodeBlock(center=pointAtParameter_3, d1=code_block_8, d2=n01_b, h=n01_h1, dy=code_block_9, direction=string_3) { createTrape(center, d1, d2, h ,dy, direction); }
byPatch_3 = Surface.ByPatch(code_block_11)
number_10 = DoubleInput(1)
number_11 = DoubleInput(0.5)
pointAtParameter_4 = Surface.PointAtParameter(surface=byPatch, u=number_10, v=number_11)
string_4 = StringInput("x+")
code_block_12 = CodeBlock(center=pointAtParameter_4, d1=code_block_8, d2=n01_b, h=n01_h1, dy=code_block_9, direction=string_4) { createTrape(center, d1, d2, h ,dy, direction); }
byPatch_4 = Surface.ByPatch(code_block_12)
number_12 = DoubleInput(0)
number_13 = DoubleInput(0.5)
pointAtParameter_5 = Surface.PointAtParameter(surface=byPatch, u=number_12, v=number_13)
string_5 = StringInput("x-")
code_block_13 = CodeBlock(center=pointAtParameter_5, d1=code_block_8, d2=n01_b, h=n01_h1, dy=code_block_9, direction=string_5) { createTrape(center, d1, d2, h ,dy, direction); }
byPatch_5 = Surface.ByPatch(code_block_13)
code_block_14 = CodeBlock()
# ---------- code_block_14.designscript (112 lines) ----------
//创建梯形平面
//p->短边中心点
//d1->短边边长
//d2->长边边长
//h->高
//d->倾斜进深
//direc->倾斜方向
def createTrape(p, d1, d2, h, d, direc)
{

 x1 = 0;
 x2 = 0;
 x3 = 0;
 x4 = 0;
 y1 = 0;
 y2 = 0;
 y3 = 0;
 y4 = 0;
 z1 = 0;
 z2 = 0;
 z3 = 0;
 z4 = 0;
 geometry = [Imperative]
 {
  if(direc == "y-")
  {
   x1 = p.X - d1 / 2;
   y1 = p.Y;
   z1 = p.Z;

   x2 = p.X + d1 / 2;
   y2 = p.Y;
   z2 = p.Z;

   x3 = p.X + d2 / 2;
   y3 = p.Y - d;
   z3 = p.Z + h;

   x4 = p.X - d2 / 2;
   y4 = p.Y - d;
   z4 = p.Z + h;
  }

  if(direc == "y+")
  {
   x1 = p.X - d1 / 2;
   y1 = p.Y;
   z1 = p.Z;

   x2 = p.X + d1 / 2;
   y2 = p.Y;
   z2 = p.Z;

   x3 = p.X + d2 / 2;
   y3 = p.Y + d;
   z3 = p.Z + h;

   x4 = p.X - d2 / 2;
   y4 = p.Y + d;
   z4 = p.Z + h;
  }

  if(direc == "x-")
  {
   x1 = p.X;
   y1 = p.Y - d1 / 2;
   z1 = p.Z;

   x2 = p.X;
   y2 = p.Y+ d1 / 2;
   z2 = p.Z;

   x3 = p.X - d;
   y3 = p.Y + d2 / 2;
   z3 = p.Z + h;

   x4 = p.X - d;
   y4 = p.Y - d2 / 2;
   z4 = p.Z + h;
  }

  if(direc == "x+")
  {
   x1 = p.X;
   y1 = p.Y- d1 / 2;
   z1 = p.Z;

   x2 = p.X;
   y2 = p.Y+ d1 / 2;
   z2 = p.Z;

   x3 = p.X + d;
   y3 = p.Y + d2 / 2;
   z3 = p.Z + h;

   x4 = p.X + d;
   y4 = p.Y - d2 / 2;
   z4 = p.Z + h;
  }

 }

 p1 = Point.ByCoordinates(x1, y1, z1);
 p2 = Point.ByCoordinates(x2, y2, z2);
 p3 = Point.ByCoordinates(x3, y3, z3);
 p4 = Point.ByCoordinates(x4, y4, z4);

 poly = Polygon.ByPoints({p1, p2, p3, p4});

 return = poly;

};
# ----------------------------------------

# group: 创建栌枓U型面
code_block_15 = CodeBlock()
# ---------- code_block_15.designscript (122 lines) ----------
//创建栌枓U型侧面
//p->底边中心定位点
//w->长边长
//w1->顶部短边长
//h1->高（h - h1)
//h2->中间U型部分高
//direc->绘制方向
def createUPlane(p, w, w1, h1, h2, direc)
{
 x1 =0;
 y1 =0;
 z1 =0;
 x2 =0;
 y2 =0;
 z2 =0;
 x3 =0;
 y3 =0;
 z3 =0;
 x4 =0;
 y4 =0;
 z4 =0;
 x5 =0;
 y5 =0;
 z5 =0;
 x6 =0;
 y6 =0;
 z6 =0;
 x7 =0;
 y7 =0;
 z7 =0;
 x8 =0;
 y8 =0;
 z8 =0;

 geometry = [Imperative]
 {

  if(direc == "x")
  {
   x1 = p.X - w / 2;
   y1 = p.Y;
   z1 = p.Z;

   x2 = p.X + w / 2;
   y2 = p.Y;
   z2 = p.Z;

   x3 = p.X + w / 2;
   y3 = p.Y;
   z3 = p.Z + h1;

   x4 = p.X + w1 / 2;
   y4 = p.Y;
   z4 = p.Z + h1;

   x5 = p.X + w1 / 2;
   y5 = p.Y;
   z5 = p.Z + h1 - h2;

   x6 = p.X - w1 / 2;
   y6 = p.Y;
   z6 = p.Z + h1 - h2;

   x7 = p.X - w1 / 2;
   y7 = p.Y;
   z7 = p.Z + h1;

   x8 = p.X - w / 2;
   y8 = p.Y;
   z8 = p.Z + h1;
  }

  if(direc == "y")
  {
   x1 = p.X;
   y1 = p.Y - w / 2;
   z1 = p.Z;

   x2 = p.X;
   y2 = p.Y + w / 2;
   z2 = p.Z;

   x3 = p.X;
   y3 = p.Y + w / 2;
   z3 = p.Z + h1;

   x4 = p.X;
   y4 = p.Y + w1 / 2;
   z4 = p.Z + h1;

   x5 = p.X;
   y5 = p.Y + w1 / 2;
   z5 = p.Z + h1 - h2;

   x6 = p.X;
   y6 = p.Y - w1 / 2;
   z6 = p.Z + h1 - h2;

   x7 = p.X;
   y7 = p.Y - w1 / 2;
   z7 = p.Z + h1;

   x8 = p.X;
   y8 = p.Y - w / 2;
   z8 = p.Z + h1;
  }

 }

 p1 = Point.ByCoordinates(x1, y1, z1);
 p2 = Point.ByCoordinates(x2, y2, z2);
 p3 = Point.ByCoordinates(x3, y3, z3);
 p4 = Point.ByCoordinates(x4, y4, z4);
 p5 = Point.ByCoordinates(x5, y5, z5);
 p6 = Point.ByCoordinates(x6, y6, z6);
 p7 = Point.ByCoordinates(x7, y7, z7);
 p8 = Point.ByCoordinates(x8, y8, z8);

 poly = Polygon.ByPoints({p1, p2, p3, p4, p5, p6, p7, p8});

 return = poly;
};
# ----------------------------------------
number_14 = DoubleInput(0)
number_15 = DoubleInput(0.5)
pointAtParameter_6 = Surface.PointAtParameter(surface=byPatch_2, u=number_14, v=number_15)
n01_b2 = DoubleInput(40)  # "01-b2"
n01_h = DoubleInput(80)  # "01-h"
code_block_16 = CodeBlock(h=n01_h, h1=n01_h1) { h - h1; }
n01_h2 = DoubleInput(36)  # "01-h2"
string_6 = StringInput("x")
code_block_17 = CodeBlock(center=pointAtParameter_6, w=n01_b, w1=n01_b2, h1=code_block_16, h2=n01_h2, direction=string_6) { createUPlane(center, w, w1, h1, h2, direction); }
pointAtParameter_7 = Surface.PointAtParameter(surface=byPatch_3, u=number_14, v=number_15)
code_block_18 = CodeBlock(center=pointAtParameter_7, w=n01_b, w1=n01_b2, h1=code_block_16, h2=n01_h2, direction=string_6) { createUPlane(center, w, w1, h1, h2, direction); }
pointAtParameter_8 = Surface.PointAtParameter(surface=byPatch_4, u=number_14, v=number_15)
string_7 = StringInput("y")
code_block_19 = CodeBlock(center=pointAtParameter_8, w=n01_b, w1=n01_b2, h1=code_block_16, h2=n01_h2, direction=string_7) { createUPlane(center, w, w1, h1, h2, direction); }
pointAtParameter_9 = Surface.PointAtParameter(surface=byPatch_5, u=number_14, v=number_15)
code_block_20 = CodeBlock(center=pointAtParameter_9, w=n01_b, w1=n01_b2, h1=code_block_16, h2=n01_h2, direction=string_7) { createUPlane(center, w, w1, h1, h2, direction); }

# group: 创建卷杀部分
code_block_21 = CodeBlock()
# ---------- code_block_21.designscript (195 lines) ----------
//创建卷杀曲线
//p->定位点
//b1->卷杀部分长
//b2->其余部分长
//m->卷杀段数
//h1->卷杀部分高
//h->整体高
//direc->方向
def createJuanshaCurve(p, b1, b2, m, h1, h, direc)
{
 x1 = 0;
 y1 = 0;
 z1 = 0;
 x2 = 0;
 y2 = 0;
 z2 = 0;
 x3 = 0;
 y3 = 0;
 z3 = 0;
 x4 = 0;
 y4 = 0;
 z4 = 0;
 x5 = 0;
 y5 = 0;
 z5 = 0;
 x6 = 0;
 y6 = 0;
 z6 = 0;
 x7 = 0;
 y7 = 0;
 z7 = 0;
 x8 = 0;
 y8 = 0;
 z8 = 0;
 geometry = [Imperative]
 {

  if(direc == "x+")
  {
   x1 = p.X;
   y1 = p.Y;
   z1 = p.Z;

   x2 = p.X + b2;
   y2 = p.Y;
   z2 = p.Z;

   x3 = p.X + b2 + ((4 / 10) * b1);
   y3 = p.Y;
   z3 = p.Z + ((1 / 10) * h1);

   x4 = p.X + b2 + ((7 / 10) * b1);
   y4 = p.Y;
   z4 = p.Z + ((3 / 10) * h1);

   x5 = p.X + b2 + ((9 / 10) * b1);
   y5 = p.Y;
   z5 = p.Z + ((6 / 10) * h1);

   x6 = p.X + b2 + b1;
   y6 = p.Y;
   z6 = p.Z + h1;

   x7 = p.X + b2 + b1;
   y7 = p.Y;
   z7 = p.Z + h;

   x8 = p.X;
   y8 = p.Y;
   z8 = p.Z + h;
  }

  if(direc == "x-")
  {
   x1 = p.X;
   y1 = p.Y;
   z1 = p.Z;

   x2 = p.X - b2;
   y2 = p.Y;
   z2 = p.Z;

   x3 = p.X - b2 - ((4 / 10) * b1);
   y3 = p.Y;
   z3 = p.Z + ((1 / 10) * h1);

   x4 = p.X - b2 - ((7 / 10) * b1);
   y4 = p.Y;
   z4 = p.Z + ((3 / 10) * h1);

   x5 = p.X - b2 - ((9 / 10) * b1);
   y5 = p.Y;
   z5 = p.Z + ((6 / 10) * h1);

   x6 = p.X - b2 - b1;
   y6 = p.Y;
   z6 = p.Z + h1;

   x7 = p.X - b2 - b1;
   y7 = p.Y;
   z7 = p.Z + h;

   x8 = p.X;
   y8 = p.Y;
   z8 = p.Z + h;
  }

  if(direc == "y+")
  {
   x1 = p.X;
   y1 = p.Y;
   z1 = p.Z;

   x2 = p.X;
   y2 = p.Y + b2;
   z2 = p.Z;

   x3 = p.X;
   y3 = p.Y + b2 + ((4 / 10) * b1);
   z3 = p.Z + ((1 / 10) * h1);

   x4 = p.X;
   y4 = p.Y + b2 + ((7 / 10) * b1);
   z4 = p.Z + ((3 / 10) * h1);

   x5 = p.X;
   y5 = p.Y + b2 + ((9 / 10) * b1);
   z5 = p.Z + ((6 / 10) * h1);

   x6 = p.X;
   y6 = p.Y + b2 + b1;
   z6 = p.Z + h1;

   x7 = p.X;
   y7 = p.Y + b2 + b1;
   z7 = p.Z + h;

   x8 = p.X;
   y8 = p.Y;
   z8 = p.Z + h;
  }

  if(direc == "y-")
  {
   x1 = p.X;
   y1 = p.Y;
   z1 = p.Z;

   x2 = p.X;
   y2 = p.Y - b2;
   z2 = p.Z;

   x3 = p.X;
   y3 = p.Y - b2 - ((4 / 10) * b1);
   z3 = p.Z + ((1 / 10) * h1);

   x4 = p.X;
   y4 = p.Y - b2 - ((7 / 10) * b1);
   z4 = p.Z + ((3 / 10) * h1);

   x5 = p.X;
   y5 = p.Y - b2 - ((9 / 10) * b1);
   z5 = p.Z + ((6 / 10) * h1);

   x6 = p.X;
   y6 = p.Y - b2 - b1;
   z6 = p.Z + h1;

   x7 = p.X;
   y7 = p.Y - b2 - b1;
   z7 = p.Z + h;

   x8 = p.X;
   y8 = p.Y;
   z8 = p.Z + h;
  }
 }


 p1 = Point.ByCoordinates(x1, y1, z1);
 p2 = Point.ByCoordinates(x2, y2, z2);
 p3 = Point.ByCoordinates(x3, y3, z3);
 p4 = Point.ByCoordinates(x4, y4, z4);
 p5 = Point.ByCoordinates(x5, y5, z5);
 p6 = Point.ByCoordinates(x6, y6, z6);
 p7 = Point.ByCoordinates(x7, y7, z7);
 p8 = Point.ByCoordinates(x8, y8, z8);

 poly = Polygon.ByPoints({p1, p2, p3, p4, p5, p6, p7, p8});

 curve = PolyCurve.ByPoints({p1, p2, p3, p4, p5, p6, p7, p8}, true);

 return = curve;

};
# ----------------------------------------
byPatch_6 = Surface.ByPatch(code_block_17)
code_block_22 = CodeBlock(h2=n01_h2, h1=code_block_16) { h2 / h1; }
code_block_23 = CodeBlock(w1=n01_b2, w=n01_b) { w1 / w; }
pointAtParameter_10 = Surface.PointAtParameter(surface=byPatch_6, u=code_block_22, v=code_block_23)
n02_b1 = DoubleInput(60)  # "02-b1"
n02_b = DoubleInput(280)  # "02-b"
b2_新定义中间参数 = CodeBlock(b=n02_b, b1=n02_b1, b_01=n01_b) { ((b - 2 * b1) - b_01) / 2; }
number_16 = DoubleInput(4)
n02_h1 = DoubleInput(32)  # "02-h1"
n02_h = DoubleInput(60)  # "02-h"
string_8 = StringInput("y-")
code_block_24 = CodeBlock(p=pointAtParameter_10, b1=n02_b1, b2=b2_新定义中间参数, m=number_16, h1=n02_h1, h=n02_h, direc=string_8) { createJuanshaCurve(p, b1, b2, m, h1, h, direc); }
code_block_25 = CodeBlock(w1=n01_b2, w=n01_b) { 1 - w1 / w; }
pointAtParameter_11 = Surface.PointAtParameter(surface=byPatch_6, u=code_block_22, v=code_block_25)
code_block_26 = CodeBlock(p=pointAtParameter_11, b1=n02_b1, b2=b2_新定义中间参数, m=number_16, h1=n02_h1, h=n02_h, direc=string_8) { createJuanshaCurve(p, b1, b2, m, h1, h, direc); }
join = List.Join(code_block_24, code_block_26)
byLoft = Surface.ByLoft(join)
byPatch_7 = Surface.ByPatch(code_block_26)
byPatch_8 = Surface.ByPatch(code_block_18)
pointAtParameter_12 = Surface.PointAtParameter(surface=byPatch_8, u=code_block_22, v=code_block_23)
string_9 = StringInput("y+")
code_block_27 = CodeBlock(p=pointAtParameter_12, b1=n02_b1, b2=b2_新定义中间参数, m=number_16, h1=n02_h1, h=n02_h, direc=string_9) { createJuanshaCurve(p, b1, b2, m, h1, h, direc); }
pointAtParameter_13 = Surface.PointAtParameter(surface=byPatch_8, u=code_block_22, v=code_block_25)
code_block_28 = CodeBlock(p=pointAtParameter_13, b1=n02_b1, b2=b2_新定义中间参数, m=number_16, h1=n02_h1, h=n02_h, direc=string_9) { createJuanshaCurve(p, b1, b2, m, h1, h, direc); }
join_2 = List.Join(code_block_27, code_block_28)
byLoft_2 = Surface.ByLoft(join_2)
byPatch_9 = Surface.ByPatch(code_block_28)
byPatch_10 = Surface.ByPatch(code_block_19)
pointAtParameter_14 = Surface.PointAtParameter(surface=byPatch_10, u=code_block_22, v=code_block_23)
string_10 = StringInput("x+")
code_block_29 = CodeBlock(p=pointAtParameter_14, b1=n02_b1, b2=b2_新定义中间参数, m=number_16, h1=n02_h1, h=n02_h, direc=string_10) { createJuanshaCurve(p, b1, b2, m, h1, h, direc); }
pointAtParameter_15 = Surface.PointAtParameter(surface=byPatch_10, u=code_block_22, v=code_block_25)
code_block_30 = CodeBlock(p=pointAtParameter_15, b1=n02_b1, b2=b2_新定义中间参数, m=number_16, h1=n02_h1, h=n02_h, direc=string_10) { createJuanshaCurve(p, b1, b2, m, h1, h, direc); }
join_3 = List.Join(code_block_29, code_block_30)
byLoft_3 = Surface.ByLoft(join_3)
byPatch_11 = Surface.ByPatch(code_block_30)
byPatch_12 = Surface.ByPatch(code_block_20)
pointAtParameter_16 = Surface.PointAtParameter(surface=byPatch_12, u=code_block_22, v=code_block_23)
string_11 = StringInput("x-")
code_block_31 = CodeBlock(p=pointAtParameter_16, b1=n02_b1, b2=b2_新定义中间参数, m=number_16, h1=n02_h1, h=n02_h, direc=string_11) { createJuanshaCurve(p, b1, b2, m, h1, h, direc); }
byPatch_13 = Surface.ByPatch(code_block_31)
pointAtParameter_17 = Surface.PointAtParameter(surface=byPatch_12, u=code_block_22, v=code_block_25)
code_block_32 = CodeBlock(p=pointAtParameter_17, b1=n02_b1, b2=b2_新定义中间参数, m=number_16, h1=n02_h1, h=n02_h, direc=string_11) { createJuanshaCurve(p, b1, b2, m, h1, h, direc); }
join_4 = List.Join(code_block_31, code_block_32)
byLoft_4 = Surface.ByLoft(join_4)
byPatch_14 = Surface.ByPatch(code_block_32)
byPatch_15 = Surface.ByPatch(code_block_24)
byPatch_16 = Surface.ByPatch(code_block_27)
byPatch_17 = Surface.ByPatch(code_block_29)

# group: 创建散枓/交互枓底面
number_17 = DoubleInput(1)
number_18 = DoubleInput(0)
pointAtParameter_18 = Surface.PointAtParameter(surface=byPatch_15, u=number_17, v=number_18)
code_block_33 = CodeBlock(b=n01_b2) { b / 2; }
translate = Geometry.Translate(geometry=pointAtParameter_18, xTranslation=code_block_33, yTranslation=code_block_33)
n04_b1 = DoubleInput(46)  # "04-b1"
code_block_34 = CodeBlock(b1=n04_b1) { b1 / 2; }
code_block_35 = CodeBlock(p=translate, r=code_block_34) { createQuadCenter(p, r); }
byPatch_18 = Surface.ByPatch(code_block_35)

# group: 创建散枓/交互枓的梯形面
number_19 = DoubleInput(0)
number_20 = DoubleInput(0.5)
number_21 = DoubleInput(1)
pointAtParameter_19 = Surface.PointAtParameter(surface=byPatch_18, u=number_20, v=number_21)
code_block_36 = CodeBlock(d1=n04_b1) { d1; }
n04_b = DoubleInput(70)  # "04-b"
n04_h1 = DoubleInput(17)  # "04-h1"
code_block_37 = CodeBlock(b=n04_b, b1=n04_b1) { (b - b1) / 2; }
string_12 = StringInput("y+")
code_block_38 = CodeBlock(center=pointAtParameter_19, d1=code_block_36, d2=n04_b, h=n04_h1, dy=code_block_37, direction=string_12) { createTrape(center, d1, d2, h ,dy, direction); }
byPatch_19 = Surface.ByPatch(code_block_38)
number_22 = DoubleInput(1)
number_23 = DoubleInput(0.5)
pointAtParameter_20 = Surface.PointAtParameter(surface=byPatch_18, u=number_22, v=number_23)
string_13 = StringInput("x+")
code_block_39 = CodeBlock(center=pointAtParameter_20, d1=code_block_36, d2=n04_b, h=n04_h1, dy=code_block_37, direction=string_13) { createTrape(center, d1, d2, h ,dy, direction); }
byPatch_20 = Surface.ByPatch(code_block_39)
number_24 = DoubleInput(0)
number_25 = DoubleInput(0.5)
pointAtParameter_21 = Surface.PointAtParameter(surface=byPatch_18, u=number_24, v=number_25)
string_14 = StringInput("x-")
code_block_40 = CodeBlock(center=pointAtParameter_21, d1=code_block_36, d2=n04_b, h=n04_h1, dy=code_block_37, direction=string_14) { createTrape(center, d1, d2, h ,dy, direction); }
byPatch_21 = Surface.ByPatch(code_block_40)
number_26 = DoubleInput(0.5)
number_27 = DoubleInput(0)
pointAtParameter_22 = Surface.PointAtParameter(surface=byPatch_18, u=number_26, v=number_27)
string_15 = StringInput("y-")
code_block_41 = CodeBlock(center=pointAtParameter_22, d1=code_block_36, d2=n04_b, h=n04_h1, d=code_block_37, direction=string_15) { createTrape(center, d1, d2, h, d, direction); }
byPatch_22 = Surface.ByPatch(code_block_41)

# group: 创建散枓U型面
number_28 = DoubleInput(0.5)
number_29 = DoubleInput(1)
pointAtParameter_23 = Surface.PointAtParameter(surface=byPatch_19, u=number_28, v=number_29)
n04_b_2 = DoubleInput(70)  # "04-b"
n04_b2 = DoubleInput(40)  # "04-b2"
n04_h = DoubleInput(45)  # "04-h"
n04_h1_2 = DoubleInput(17)  # "04-h1"
code_block_42 = CodeBlock(h=n04_h, h1=n04_h1_2) { h - h1; }
n04_h2 = DoubleInput(18)  # "04-h2"
string_16 = StringInput("x")
code_block_43 = CodeBlock(center=pointAtParameter_23, w=n04_b_2, w1=n04_b2, h1=code_block_42, h2=n04_h2, cirection=string_16) { createUPlane(center, w, w1, h1, h2, cirection); }
byPatch_23 = Surface.ByPatch(code_block_43)
number_30 = DoubleInput(0)
number_31 = DoubleInput(0.5)
pointAtParameter_24 = Surface.PointAtParameter(surface=byPatch_20, u=number_30, v=number_31)
number_32 = DoubleInput(0)
string_17 = StringInput("y")
code_block_44 = CodeBlock(center=pointAtParameter_24, w=n04_b_2, w1=n04_b2, h1=code_block_42, h2=number_32, cirection=string_17) { createUPlane(center, w, w1, h1, h2, cirection); }
byPatch_24 = Surface.ByPatch(code_block_44)
number_33 = DoubleInput(0)
number_34 = DoubleInput(0.5)
pointAtParameter_25 = Surface.PointAtParameter(surface=byPatch_21, u=number_33, v=number_34)
code_block_45 = CodeBlock(center=pointAtParameter_25, w=n04_b_2, w1=n04_b2, h1=code_block_42, h2=number_32, cirection=string_17) { createUPlane(center, w, w1, h1, h2, cirection); }
byPatch_25 = Surface.ByPatch(code_block_45)
number_35 = DoubleInput(0.5)
number_36 = DoubleInput(0)
pointAtParameter_26 = Surface.PointAtParameter(surface=byPatch_22, u=number_35, v=number_36)
code_block_46 = CodeBlock(center=pointAtParameter_26, w=n04_b_2, w1=n04_b2, h1=code_block_42, h2=n04_h2, cirection=string_16) { createUPlane(center, w, w1, h1, h2, cirection); }
byPatch_26 = Surface.ByPatch(code_block_46)

# group: 创建散枓/交互枓底面
number_37 = DoubleInput(0)
number_38 = DoubleInput(1)
pointAtParameter_27 = Surface.PointAtParameter(surface=byPatch_16, u=number_37, v=number_38)
code_block_47 = CodeBlock(b=n01_b2) { b / 2; }
code_block_48 = CodeBlock(y=code_block_47) { -y; }
translate_2 = Geometry.Translate(geometry=pointAtParameter_27, xTranslation=code_block_47, yTranslation=code_block_48)
n04_b1_2 = DoubleInput(46)  # "04-b1"
code_block_49 = CodeBlock(b1=n04_b1_2) { b1 / 2; }
code_block_50 = CodeBlock(p=translate_2, r=code_block_49) { createQuadCenter(p, r); }
byPatch_27 = Surface.ByPatch(code_block_50)

# group: 创建散枓/交互枓的梯形面
number_39 = DoubleInput(0)
number_40 = DoubleInput(1)
number_41 = DoubleInput(0.5)
pointAtParameter_28 = Surface.PointAtParameter(surface=byPatch_27, u=number_40, v=number_41)
code_block_51 = CodeBlock(d1=n04_b1_2) { d1; }
n04_b_3 = DoubleInput(68)  # "04-b"
n04_h1_3 = DoubleInput(17)  # "04-h1"
code_block_52 = CodeBlock(b=n04_b_3, b1=n04_b1_2) { (b - b1) / 2; }
string_18 = StringInput("x+")
code_block_53 = CodeBlock(center=pointAtParameter_28, d1=code_block_51, d2=n04_b_3, h=n04_h1_3, dy=code_block_52, direction=string_18) { createTrape(center, d1, d2, h ,dy, direction); }
byPatch_28 = Surface.ByPatch(code_block_53)
number_42 = DoubleInput(0.5)
number_43 = DoubleInput(0)
pointAtParameter_29 = Surface.PointAtParameter(surface=byPatch_27, u=number_42, v=number_43)
string_19 = StringInput("y-")
code_block_54 = CodeBlock(center=pointAtParameter_29, d1=code_block_51, d2=n04_b_3, h=n04_h1_3, d=code_block_52, direction=string_19) { createTrape(center, d1, d2, h, d, direction); }
byPatch_29 = Surface.ByPatch(code_block_54)
number_44 = DoubleInput(0)
number_45 = DoubleInput(0.5)
pointAtParameter_30 = Surface.PointAtParameter(surface=byPatch_27, u=number_44, v=number_45)
string_20 = StringInput("x-")
code_block_55 = CodeBlock(center=pointAtParameter_30, d1=code_block_51, d2=n04_b_3, h=n04_h1_3, dy=code_block_52, direction=string_20) { createTrape(center, d1, d2, h ,dy, direction); }
byPatch_30 = Surface.ByPatch(code_block_55)
number_46 = DoubleInput(0.5)
number_47 = DoubleInput(1)
pointAtParameter_31 = Surface.PointAtParameter(surface=byPatch_27, u=number_46, v=number_47)
string_21 = StringInput("y+")
code_block_56 = CodeBlock(center=pointAtParameter_31, d1=code_block_51, d2=n04_b_3, h=n04_h1_3, dy=code_block_52, direction=string_21) { createTrape(center, d1, d2, h ,dy, direction); }
byPatch_31 = Surface.ByPatch(code_block_56)

# group: 创建散枓U型面
number_48 = DoubleInput(0)
number_49 = DoubleInput(0.5)
pointAtParameter_32 = Surface.PointAtParameter(surface=byPatch_28, u=number_48, v=number_49)
n04_b_4 = DoubleInput(70)  # "04-b"
n04_b2_2 = DoubleInput(40)  # "04-b2"
n04_h_2 = DoubleInput(45)  # "04-h"
n04_h1_4 = DoubleInput(17)  # "04-h1"
code_block_57 = CodeBlock(h=n04_h_2, h1=n04_h1_4) { h - h1; }
number_50 = DoubleInput(0)
string_22 = StringInput("y")
code_block_58 = CodeBlock(center=pointAtParameter_32, w=n04_b_4, w1=n04_b2_2, h1=code_block_57, h2=number_50, cirection=string_22) { createUPlane(center, w, w1, h1, h2, cirection); }
byPatch_32 = Surface.ByPatch(code_block_58)
number_51 = DoubleInput(0.5)
number_52 = DoubleInput(0)
pointAtParameter_33 = Surface.PointAtParameter(surface=byPatch_29, u=number_51, v=number_52)
n04_h2_2 = DoubleInput(18)  # "04-h2"
string_23 = StringInput("x")
code_block_59 = CodeBlock(center=pointAtParameter_33, w=n04_b_4, w1=n04_b2_2, h1=code_block_57, h2=n04_h2_2, cirection=string_23) { createUPlane(center, w, w1, h1, h2, cirection); }
byPatch_33 = Surface.ByPatch(code_block_59)
number_53 = DoubleInput(0)
number_54 = DoubleInput(0.5)
pointAtParameter_34 = Surface.PointAtParameter(surface=byPatch_30, u=number_53, v=number_54)
code_block_60 = CodeBlock(center=pointAtParameter_34, w=n04_b_4, w1=n04_b2_2, h1=code_block_57, h2=number_50, cirection=string_22) { createUPlane(center, w, w1, h1, h2, cirection); }
byPatch_34 = Surface.ByPatch(code_block_60)
number_55 = DoubleInput(0.5)
number_56 = DoubleInput(1)
pointAtParameter_35 = Surface.PointAtParameter(surface=byPatch_31, u=number_55, v=number_56)
code_block_61 = CodeBlock(center=pointAtParameter_35, w=n04_b_4, w1=n04_b2_2, h1=code_block_57, h2=n04_h2_2, cirection=string_23) { createUPlane(center, w, w1, h1, h2, cirection); }
byPatch_35 = Surface.ByPatch(code_block_61)

# group: 创建散枓/交互枓底面
number_57 = DoubleInput(0)
number_58 = DoubleInput(1)
pointAtParameter_36 = Surface.PointAtParameter(surface=byPatch_17, u=number_57, v=number_58)
code_block_62 = CodeBlock(b=n01_b2) { b / 2; }
code_block_63 = CodeBlock(x=code_block_62) { -x; }
translate_3 = Geometry.Translate(geometry=pointAtParameter_36, xTranslation=code_block_63, yTranslation=code_block_62)
n04_b1_3 = DoubleInput(46)  # "04-b1"
code_block_64 = CodeBlock(b1=n04_b1_3) { b1 / 2; }
code_block_65 = CodeBlock(p=translate_3, r=code_block_64) { createQuadCenter(p, r); }
byPatch_36 = Surface.ByPatch(code_block_65)

# group: 创建散枓/交互枓的梯形面
number_59 = DoubleInput(0)
number_60 = DoubleInput(0.5)
number_61 = DoubleInput(0)
pointAtParameter_37 = Surface.PointAtParameter(surface=byPatch_36, u=number_60, v=number_61)
code_block_66 = CodeBlock(d1=n04_b1_3) { d1; }
n04_b_5 = DoubleInput(68)  # "04-b"
n04_h1_5 = DoubleInput(17)  # "04-h1"
code_block_67 = CodeBlock(b=n04_b_5, b1=n04_b1_3) { (b - b1) / 2; }
string_24 = StringInput("y-")
code_block_68 = CodeBlock(center=pointAtParameter_37, d1=code_block_66, d2=n04_b_5, h=n04_h1_5, d=code_block_67, direction=string_24) { createTrape(center, d1, d2, h, d, direction); }
byPatch_37 = Surface.ByPatch(code_block_68)
number_62 = DoubleInput(0)
number_63 = DoubleInput(0.5)
pointAtParameter_38 = Surface.PointAtParameter(surface=byPatch_36, u=number_62, v=number_63)
string_25 = StringInput("x-")
code_block_69 = CodeBlock(center=pointAtParameter_38, d1=code_block_66, d2=n04_b_5, h=n04_h1_5, dy=code_block_67, direction=string_25) { createTrape(center, d1, d2, h ,dy, direction); }
byPatch_38 = Surface.ByPatch(code_block_69)
number_64 = DoubleInput(0.5)
number_65 = DoubleInput(1)
pointAtParameter_39 = Surface.PointAtParameter(surface=byPatch_36, u=number_64, v=number_65)
string_26 = StringInput("y+")
code_block_70 = CodeBlock(center=pointAtParameter_39, d1=code_block_66, d2=n04_b_5, h=n04_h1_5, dy=code_block_67, direction=string_26) { createTrape(center, d1, d2, h ,dy, direction); }
byPatch_39 = Surface.ByPatch(code_block_70)
number_66 = DoubleInput(1)
number_67 = DoubleInput(0.5)
pointAtParameter_40 = Surface.PointAtParameter(surface=byPatch_36, u=number_66, v=number_67)
string_27 = StringInput("x+")
code_block_71 = CodeBlock(center=pointAtParameter_40, d1=code_block_66, d2=n04_b_5, h=n04_h1_5, dy=code_block_67, direction=string_27) { createTrape(center, d1, d2, h ,dy, direction); }
byPatch_40 = Surface.ByPatch(code_block_71)

# group: 创建散枓U型面
number_68 = DoubleInput(0)
number_69 = DoubleInput(0.5)
number_70 = DoubleInput(0)
pointAtParameter_41 = Surface.PointAtParameter(surface=byPatch_37, u=number_69, v=number_70)
n04_b_6 = DoubleInput(70)  # "04-b"
n04_b2_3 = DoubleInput(40)  # "04-b2"
n04_h_3 = DoubleInput(45)  # "04-h"
n04_h1_6 = DoubleInput(17)  # "04-h1"
code_block_72 = CodeBlock(h=n04_h_3, h1=n04_h1_6) { h - h1; }
n04_h2_3 = DoubleInput(18)  # "04-h2"
string_28 = StringInput("x")
code_block_73 = CodeBlock(center=pointAtParameter_41, w=n04_b_6, w1=n04_b2_3, h1=code_block_72, h2=n04_h2_3, cirection=string_28) { createUPlane(center, w, w1, h1, h2, cirection); }
byPatch_41 = Surface.ByPatch(code_block_73)
number_71 = DoubleInput(0)
number_72 = DoubleInput(0.5)
pointAtParameter_42 = Surface.PointAtParameter(surface=byPatch_38, u=number_71, v=number_72)
string_29 = StringInput("y")
code_block_74 = CodeBlock(center=pointAtParameter_42, w=n04_b_6, w1=n04_b2_3, h1=code_block_72, h2=n04_h2_3, cirection=string_29) { createUPlane(center, w, w1, h1, h2, cirection); }
byPatch_42 = Surface.ByPatch(code_block_74)
number_73 = DoubleInput(0.5)
number_74 = DoubleInput(1)
pointAtParameter_43 = Surface.PointAtParameter(surface=byPatch_39, u=number_73, v=number_74)
code_block_75 = CodeBlock(center=pointAtParameter_43, w=n04_b_6, w1=n04_b2_3, h1=code_block_72, h2=n04_h2_3, cirection=string_28) { createUPlane(center, w, w1, h1, h2, cirection); }
byPatch_43 = Surface.ByPatch(code_block_75)
number_75 = DoubleInput(0)
number_76 = DoubleInput(0.5)
pointAtParameter_44 = Surface.PointAtParameter(surface=byPatch_40, u=number_75, v=number_76)
code_block_76 = CodeBlock(center=pointAtParameter_44, w=n04_b_6, w1=n04_b2_3, h1=code_block_72, h2=n04_h2_3, cirection=string_29) { createUPlane(center, w, w1, h1, h2, cirection); }
byPatch_44 = Surface.ByPatch(code_block_76)

# group: 创建卷杀部分
code_block_77 = CodeBlock(h2=n04_h2, h1=code_block_42) { h2 / h1; }
code_block_78 = CodeBlock(b=n04_b, b2=n04_b2) { ((b - b2) / 2) + b2; }
code_block_79 = CodeBlock(w1=code_block_78, w=n04_b) { w1 / w; }
pointAtParameter_45 = Surface.PointAtParameter(surface=byPatch_26, u=code_block_77, v=code_block_79)
n06_b1 = DoubleInput(60)  # "06-b1"
n06_b = DoubleInput(468)  # "06-b"
code_block_80 = CodeBlock(b=n06_b, b1=n06_b1, b_01=n02_b, d_04=code_block_37) { ((b - 2 * b1) - b_01 - 2 * d_04) / 2; }
number_77 = DoubleInput(4)
n06_h1 = DoubleInput(32)  # "06-h1"
n06_h = DoubleInput(64)  # "06-h"
string_30 = StringInput("y-")
code_block_81 = CodeBlock(p=pointAtParameter_45, b1=n06_b1, b2=code_block_80, m=number_77, h1=n06_h1, h=n06_h, direc=string_30) { createJuanshaCurve(p, b1, b2, m, h1, h, direc); }
byPatch_45 = Surface.ByPatch(code_block_81)
code_block_82 = CodeBlock(w1=code_block_78, w=n04_b) { 1 - w1 / w; }
pointAtParameter_46 = Surface.PointAtParameter(surface=byPatch_26, u=code_block_77, v=code_block_82)
code_block_83 = CodeBlock(p=pointAtParameter_46, b1=n06_b1, b2=code_block_80, m=number_77, h1=n06_h1, h=n06_h, direc=string_30) { createJuanshaCurve(p, b1, b2, m, h1, h, direc); }
byPatch_46 = Surface.ByPatch(code_block_83)
join_5 = List.Join(code_block_81, code_block_83)
byLoft_5 = PolySurface.ByLoft(join_5)

# group: 创建卷杀部分
code_block_84 = CodeBlock(h2=n04_h2, h1=code_block_42) { h2 / h1; }
code_block_85 = CodeBlock(b=n04_b, b2=n04_b2) { ((b - b2) / 2) + b2; }
code_block_86 = CodeBlock(w1=code_block_85, w=n04_b) { w1 / w; }
pointAtParameter_47 = Surface.PointAtParameter(surface=byPatch_35, u=code_block_84, v=code_block_86)
n06_b1_2 = DoubleInput(60)  # "06-b1"
n06_b_2 = DoubleInput(468)  # "06-b"
code_block_87 = CodeBlock(b=n06_b_2, b1=n06_b1_2, b_01=n02_b, d_04=code_block_37) { ((b - 2 * b1) - b_01 - 2 * d_04) / 2; }
number_78 = DoubleInput(4)
n06_h1_2 = DoubleInput(32)  # "06-h1"
n06_h_2 = DoubleInput(64)  # "06-h"
string_31 = StringInput("y+")
code_block_88 = CodeBlock(p=pointAtParameter_47, b1=n06_b1_2, b2=code_block_87, m=number_78, h1=n06_h1_2, h=n06_h_2, direc=string_31) { createJuanshaCurve(p, b1, b2, m, h1, h, direc); }
byPatch_47 = Surface.ByPatch(code_block_88)
code_block_89 = CodeBlock(w1=code_block_85, w=n04_b) { 1 - w1 / w; }
pointAtParameter_48 = Surface.PointAtParameter(surface=byPatch_35, u=code_block_84, v=code_block_89)
code_block_90 = CodeBlock(p=pointAtParameter_48, b1=n06_b1_2, b2=code_block_87, m=number_78, h1=n06_h1_2, h=n06_h_2, direc=string_31) { createJuanshaCurve(p, b1, b2, m, h1, h, direc); }
byPatch_48 = Surface.ByPatch(code_block_90)
join_6 = List.Join(code_block_88, code_block_90)
byLoft_6 = PolySurface.ByLoft(join_6)

# group: 创建卷杀部分
code_block_91 = CodeBlock(h2=n04_h2, h1=code_block_42) { h2 / h1; }
code_block_92 = CodeBlock(b=n04_b, b2=n04_b2) { ((b - b2) / 2) + b2; }
code_block_93 = CodeBlock(w1=code_block_92, w=n04_b) { w1 / w; }
pointAtParameter_49 = Surface.PointAtParameter(surface=byPatch_44, u=code_block_91, v=code_block_93)
n06_b1_3 = DoubleInput(60)  # "06-b1"
n06_b_3 = DoubleInput(468)  # "06-b"
code_block_94 = CodeBlock(b=n06_b_3, b1=n06_b1_3, b_01=n02_b, d_04=code_block_37) { ((b - 2 * b1) - b_01 - 2 * d_04) / 2; }
number_79 = DoubleInput(4)
n06_h1_3 = DoubleInput(32)  # "06-h1"
n06_h_3 = DoubleInput(64)  # "06-h"
string_32 = StringInput("x+")
code_block_95 = CodeBlock(p=pointAtParameter_49, b1=n06_b1_3, b2=code_block_94, m=number_79, h1=n06_h1_3, h=n06_h_3, direc=string_32) { createJuanshaCurve(p, b1, b2, m, h1, h, direc); }
byPatch_49 = Surface.ByPatch(code_block_95)
code_block_96 = CodeBlock(w1=code_block_92, w=n04_b) { 1 - w1 / w; }
pointAtParameter_50 = Surface.PointAtParameter(surface=byPatch_44, u=code_block_91, v=code_block_96)
code_block_97 = CodeBlock(p=pointAtParameter_50, b1=n06_b1_3, b2=code_block_94, m=number_79, h1=n06_h1_3, h=n06_h_3, direc=string_32) { createJuanshaCurve(p, b1, b2, m, h1, h, direc); }
byPatch_50 = Surface.ByPatch(code_block_97)
join_7 = List.Join(code_block_95, code_block_97)
byLoft_7 = PolySurface.ByLoft(join_7)

# group: 创建中间柱形体
surfaces = PolySurface.Surfaces(byLoft_5)
number_80 = DoubleInput(7)
getItemAtIndex = List.GetItemAtIndex(list=surfaces, index=number_80)
perimeterCurves = Surface.PerimeterCurves(getItemAtIndex)
byJoinedCurves = PolyCurve.ByJoinedCurves(perimeterCurves)
surfaces_2 = PolySurface.Surfaces(byLoft_6)
number_81 = DoubleInput(7)
getItemAtIndex_2 = List.GetItemAtIndex(list=surfaces_2, index=number_81)
perimeterCurves_2 = Surface.PerimeterCurves(getItemAtIndex_2)
byJoinedCurves_2 = PolyCurve.ByJoinedCurves(perimeterCurves_2)
join_8 = List.Join(byJoinedCurves, byJoinedCurves_2)
byLoft_8 = PolySurface.ByLoft(join_8)

# group: 创建单卷杀栱长方体部分
code_block_98 = CodeBlock()
# ---------- code_block_98.designscript (68 lines) ----------
//创建单卷杀长方体栱部分，
//cur->边界曲线
//width->长方体长度
//direction->延伸方向
def createCubiod(cur, width, direction)
{
 x1 = 0;
 y1 = 0;
 z1 = 0;
 x2 = 0;
 y2 = 0;
 z2 = 0;

 geometry = [Imperative]
 {
  if(direction == "x+")
  {
   x1 = cur.StartPoint.X + width;
   y1 = cur.StartPoint.Y;
   z1 = cur.StartPoint.Z;

   x2 = cur.EndPoint.X + width;
   y2 = cur.EndPoint.Y;
   z2 = cur.EndPoint.Z;
  }

  if(direction == "x-")
  {
   x1 = cur.StartPoint.X - width;
   y1 = cur.StartPoint.Y;
   z1 = cur.StartPoint.Z;

   x2 = cur.EndPoint.X - width;
   y2 = cur.EndPoint.Y;
   z2 = cur.EndPoint.Z;
  }

  if(direction == "y+")
  {
   x1 = cur.StartPoint.X;
   y1 = cur.StartPoint.Y + width;
   z1 = cur.StartPoint.Z;

   x2 = cur.EndPoint.X;
   y2 = cur.EndPoint.Y + width;
   z2 = cur.EndPoint.Z;
  }

  if(direction == "y-")
  {
   x1 = cur.StartPoint.X;
   y1 = cur.StartPoint.Y - width;
   z1 = cur.StartPoint.Z;

   x2 = cur.EndPoint.X;
   y2 = cur.EndPoint.Y - width;
   z2 = cur.EndPoint.Z;
  }
 }

 p1 = Point.ByCoordinates(x1, y1, z1);
 p2 = Point.ByCoordinates(x2, y2, z2);

 curve = PolyCurve.ByPoints({p1, p2}, false);

 return = curve;

};
# ----------------------------------------
surfaces_3 = PolySurface.Surfaces(byLoft_7)
number_82 = DoubleInput(7)
getItemAtIndex_3 = List.GetItemAtIndex(list=surfaces_3, index=number_82)
perimeterCurves_3 = Surface.PerimeterCurves(getItemAtIndex_3)
byJoinedCurves_3 = PolyCurve.ByJoinedCurves(perimeterCurves_3)
number_83 = DoubleInput(0)
getItemAtIndex_4 = List.GetItemAtIndex(list=perimeterCurves_3, index=number_83)
n08_b = DoubleInput(396)  # "08-b"
code_block_99 = CodeBlock(b=n08_b, b1=n06_b1_3, d=code_block_94) { b - b1 - d; }
string_33 = StringInput("x-")
code_block_100 = CodeBlock(curve=getItemAtIndex_4, width=code_block_99, direction=string_33) { createCubiod(curve, width, direction); }
number_84 = DoubleInput(1)
getItemAtIndex_5 = List.GetItemAtIndex(list=perimeterCurves_3, index=number_84)
code_block_101 = CodeBlock(curve=getItemAtIndex_5, width=code_block_99, direction=string_33) { createCubiod(curve, width, direction); }
number_85 = DoubleInput(2)
getItemAtIndex_6 = List.GetItemAtIndex(list=perimeterCurves_3, index=number_85)
code_block_102 = CodeBlock(curve=getItemAtIndex_6, width=code_block_99, direction=string_33) { createCubiod(curve, width, direction); }
number_86 = DoubleInput(3)
getItemAtIndex_7 = List.GetItemAtIndex(list=perimeterCurves_3, index=number_86)
code_block_103 = CodeBlock(curve=getItemAtIndex_7, width=code_block_99, direction=string_33) { createCubiod(curve, width, direction); }
join_9 = List.Join(code_block_100, code_block_101, code_block_102, code_block_103)
byJoinedCurves_4 = PolyCurve.ByJoinedCurves(join_9)
join_10 = List.Join(byJoinedCurves_3, byJoinedCurves_4)
byLoft_9 = Solid.ByLoft(join_10)
