# Dynamo graph testfor.dyn (Dynamo 0.9.1.4062)

# group: Utils
code_block = CodeBlock()
# ---------- code_block.designscript (46 lines) ----------
//创建四边形面
//p->面的中心点
//r->面的边长
//z->面的位置z值
def createQuadCenter(p, r)
{
 // .p1----.p2
 // |  |
 // | p |
 // |  |
 // |  |
 // .p4----.p3
 x1 = p.X - r;
 y1 = p.Y - r;
 z1 = p.Z;

 //test=p.X;

 x2 = p.X + r;
 y2 = p.Y - r;
 z2 = p.Z;

 x3 = p.X + r;
 y3 = p.Y + r;
 z3 = p.Z;

 x4 = p.X - r;
 y4 = p.Y + r;
 z4 = p.Z;

 p1 = Point.ByCoordinates(x1, y1, z1);
 p2 = Point.ByCoordinates(x2, y2, z2);
 p3 = Point.ByCoordinates(x3, y3, z3);
 p4 = Point.ByCoordinates(x4, y4, z4);

 poly = Polygon.ByPoints({p1, p2, p3, p4});

 //l1 = List.FirstItem(p1);
 //l1 = List.AddItemToEnd(p2);
 //l1 = List.AddItemToEnd(p3);
 //l1 = List.AddItemToEnd(p4);

 //sur = Surface.ByPatch(ploy);

 return = poly;
};
# ----------------------------------------
code_block_2 = CodeBlock()
# ---------- code_block_2.designscript (112 lines) ----------
//创建梯形平面
//p->短边中心点
//d1->短边边长
//d2->长边边长
//h->高
//d->倾斜进深
//direc->倾斜方向
def createTrape(p, d1, d2, h, d, direc)
{

 x1 = 0;
 x2 = 0;
 x3 = 0;
 x4 = 0;
 y1 = 0;
 y2 = 0;
 y3 = 0;
 y4 = 0;
 z1 = 0;
 z2 = 0;
 z3 = 0;
 z4 = 0;
 geometry = [Imperative]
 {
  if(direc == "y-")
  {
   x1 = p.X - d1 / 2;
   y1 = p.Y;
   z1 = p.Z;

   x2 = p.X + d1 / 2;
   y2 = p.Y;
   z2 = p.Z;

   x3 = p.X + d2 / 2;
   y3 = p.Y - d;
   z3 = p.Z + h;

   x4 = p.X - d2 / 2;
   y4 = p.Y - d;
   z4 = p.Z + h;
  }

  if(direc == "y+")
  {
   x1 = p.X - d1 / 2;
   y1 = p.Y;
   z1 = p.Z;

   x2 = p.X + d1 / 2;
   y2 = p.Y;
   z2 = p.Z;

   x3 = p.X + d2 / 2;
   y3 = p.Y + d;
   z3 = p.Z + h;

   x4 = p.X - d2 / 2;
   y4 = p.Y + d;
   z4 = p.Z + h;
  }

  if(direc == "x-")
  {
   x1 = p.X;
   y1 = p.Y - d1 / 2;
   z1 = p.Z;

   x2 = p.X;
   y2 = p.Y+ d1 / 2;
   z2 = p.Z;

   x3 = p.X - d;
   y3 = p.Y + d2 / 2;
   z3 = p.Z + h;

   x4 = p.X - d;
   y4 = p.Y - d2 / 2;
   z4 = p.Z + h;
  }

  if(direc == "x+")
  {
   x1 = p.X;
   y1 = p.Y- d1 / 2;
   z1 = p.Z;

   x2 = p.X;
   y2 = p.Y+ d1 / 2;
   z2 = p.Z;

   x3 = p.X + d;
   y3 = p.Y + d2 / 2;
   z3 = p.Z + h;

   x4 = p.X + d;
   y4 = p.Y - d2 / 2;
   z4 = p.Z + h;
  }

 }

 p1 = Point.ByCoordinates(x1, y1, z1);
 p2 = Point.ByCoordinates(x2, y2, z2);
 p3 = Point.ByCoordinates(x3, y3, z3);
 p4 = Point.ByCoordinates(x4, y4, z4);

 poly = Polygon.ByPoints({p1, p2, p3, p4});

 return = poly;

};
# ----------------------------------------
code_block_3 = CodeBlock()
# ---------- code_block_3.designscript (122 lines) ----------
//创建栌枓U型侧面
//p->底边中心定位点
//w->长边长
//w1->顶部短边长
//h1->高（h - h1)
//h2->中间U型部分高
//direc->绘制方向
def createUPlane(p, w, w1, h1, h2, direc)
{
 x1 =0;
 y1 =0;
 z1 =0;
 x2 =0;
 y2 =0;
 z2 =0;
 x3 =0;
 y3 =0;
 z3 =0;
 x4 =0;
 y4 =0;
 z4 =0;
 x5 =0;
 y5 =0;
 z5 =0;
 x6 =0;
 y6 =0;
 z6 =0;
 x7 =0;
 y7 =0;
 z7 =0;
 x8 =0;
 y8 =0;
 z8 =0;

 geometry = [Imperative]
 {

  if(direc == "x")
  {
   x1 = p.X - w / 2;
   y1 = p.Y;
   z1 = p.Z;

   x2 = p.X + w / 2;
   y2 = p.Y;
   z2 = p.Z;

   x3 = p.X + w / 2;
   y3 = p.Y;
   z3 = p.Z + h1;

   x4 = p.X + w1 / 2;
   y4 = p.Y;
   z4 = p.Z + h1;

   x5 = p.X + w1 / 2;
   y5 = p.Y;
   z5 = p.Z + h1 - h2;

   x6 = p.X - w1 / 2;
   y6 = p.Y;
   z6 = p.Z + h1 - h2;

   x7 = p.X - w1 / 2;
   y7 = p.Y;
   z7 = p.Z + h1;

   x8 = p.X - w / 2;
   y8 = p.Y;
   z8 = p.Z + h1;
  }

  if(direc == "y")
  {
   x1 = p.X;
   y1 = p.Y - w / 2;
   z1 = p.Z;

   x2 = p.X;
   y2 = p.Y + w / 2;
   z2 = p.Z;

   x3 = p.X;
   y3 = p.Y + w / 2;
   z3 = p.Z + h1;

   x4 = p.X;
   y4 = p.Y + w1 / 2;
   z4 = p.Z + h1;

   x5 = p.X;
   y5 = p.Y + w1 / 2;
   z5 = p.Z + h1 - h2;

   x6 = p.X;
   y6 = p.Y - w1 / 2;
   z6 = p.Z + h1 - h2;

   x7 = p.X;
   y7 = p.Y - w1 / 2;
   z7 = p.Z + h1;

   x8 = p.X;
   y8 = p.Y - w / 2;
   z8 = p.Z + h1;
  }

 }

 p1 = Point.ByCoordinates(x1, y1, z1);
 p2 = Point.ByCoordinates(x2, y2, z2);
 p3 = Point.ByCoordinates(x3, y3, z3);
 p4 = Point.ByCoordinates(x4, y4, z4);
 p5 = Point.ByCoordinates(x5, y5, z5);
 p6 = Point.ByCoordinates(x6, y6, z6);
 p7 = Point.ByCoordinates(x7, y7, z7);
 p8 = Point.ByCoordinates(x8, y8, z8);

 poly = Polygon.ByPoints({p1, p2, p3, p4, p5, p6, p7, p8});

 return = poly;
};
# ----------------------------------------
code_block_4 = CodeBlock()
# ---------- code_block_4.designscript (195 lines) ----------
//创建卷杀曲线
//p->定位点
//b1->卷杀部分长
//b2->其余部分长
//m->卷杀段数
//h1->卷杀部分高
//h->整体高
//direc->方向
def createJuanshaCurve(p, b1, b2, m, h1, h, direc)
{
 x1 = 0;
 y1 = 0;
 z1 = 0;
 x2 = 0;
 y2 = 0;
 z2 = 0;
 x3 = 0;
 y3 = 0;
 z3 = 0;
 x4 = 0;
 y4 = 0;
 z4 = 0;
 x5 = 0;
 y5 = 0;
 z5 = 0;
 x6 = 0;
 y6 = 0;
 z6 = 0;
 x7 = 0;
 y7 = 0;
 z7 = 0;
 x8 = 0;
 y8 = 0;
 z8 = 0;
 geometry = [Imperative]
 {

  if(direc == "x+")
  {
   x1 = p.X;
   y1 = p.Y;
   z1 = p.Z;

   x2 = p.X + b2;
   y2 = p.Y;
   z2 = p.Z;

   x3 = p.X + b2 + ((4 / 10) * b1);
   y3 = p.Y;
   z3 = p.Z + ((1 / 10) * h1);

   x4 = p.X + b2 + ((7 / 10) * b1);
   y4 = p.Y;
   z4 = p.Z + ((3 / 10) * h1);

   x5 = p.X + b2 + ((9 / 10) * b1);
   y5 = p.Y;
   z5 = p.Z + ((6 / 10) * h1);

   x6 = p.X + b2 + b1;
   y6 = p.Y;
   z6 = p.Z + h1;

   x7 = p.X + b2 + b1;
   y7 = p.Y;
   z7 = p.Z + h;

   x8 = p.X;
   y8 = p.Y;
   z8 = p.Z + h;
  }

  if(direc == "x-")
  {
   x1 = p.X;
   y1 = p.Y;
   z1 = p.Z;

   x2 = p.X - b2;
   y2 = p.Y;
   z2 = p.Z;

   x3 = p.X - b2 - ((4 / 10) * b1);
   y3 = p.Y;
   z3 = p.Z + ((1 / 10) * h1);

   x4 = p.X - b2 - ((7 / 10) * b1);
   y4 = p.Y;
   z4 = p.Z + ((3 / 10) * h1);

   x5 = p.X - b2 - ((9 / 10) * b1);
   y5 = p.Y;
   z5 = p.Z + ((6 / 10) * h1);

   x6 = p.X - b2 - b1;
   y6 = p.Y;
   z6 = p.Z + h1;

   x7 = p.X - b2 - b1;
   y7 = p.Y;
   z7 = p.Z + h;

   x8 = p.X;
   y8 = p.Y;
   z8 = p.Z + h;
  }

  if(direc == "y+")
  {
   x1 = p.X;
   y1 = p.Y;
   z1 = p.Z;

   x2 = p.X;
   y2 = p.Y + b2;
   z2 = p.Z;

   x3 = p.X;
   y3 = p.Y + b2 + ((4 / 10) * b1);
   z3 = p.Z + ((1 / 10) * h1);

   x4 = p.X;
   y4 = p.Y + b2 + ((7 / 10) * b1);
   z4 = p.Z + ((3 / 10) * h1);

   x5 = p.X;
   y5 = p.Y + b2 + ((9 / 10) * b1);
   z5 = p.Z + ((6 / 10) * h1);

   x6 = p.X;
   y6 = p.Y + b2 + b1;
   z6 = p.Z + h1;

   x7 = p.X;
   y7 = p.Y + b2 + b1;
   z7 = p.Z + h;

   x8 = p.X;
   y8 = p.Y;
   z8 = p.Z + h;
  }

  if(direc == "y-")
  {
   x1 = p.X;
   y1 = p.Y;
   z1 = p.Z;

   x2 = p.X;
   y2 = p.Y - b2;
   z2 = p.Z;

   x3 = p.X;
   y3 = p.Y - b2 - ((4 / 10) * b1);
   z3 = p.Z + ((1 / 10) * h1);

   x4 = p.X;
   y4 = p.Y - b2 - ((7 / 10) * b1);
   z4 = p.Z + ((3 / 10) * h1);

   x5 = p.X;
   y5 = p.Y - b2 - ((9 / 10) * b1);
   z5 = p.Z + ((6 / 10) * h1);

   x6 = p.X;
   y6 = p.Y - b2 - b1;
   z6 = p.Z + h1;

   x7 = p.X;
   y7 = p.Y - b2 - b1;
   z7 = p.Z + h;

   x8 = p.X;
   y8 = p.Y;
   z8 = p.Z + h;
  }
 }


 p1 = Point.ByCoordinates(x1, y1, z1);
 p2 = Point.ByCoordinates(x2, y2, z2);
 p3 = Point.ByCoordinates(x3, y3, z3);
 p4 = Point.ByCoordinates(x4, y4, z4);
 p5 = Point.ByCoordinates(x5, y5, z5);
 p6 = Point.ByCoordinates(x6, y6, z6);
 p7 = Point.ByCoordinates(x7, y7, z7);
 p8 = Point.ByCoordinates(x8, y8, z8);

 poly = Polygon.ByPoints({p1, p2, p3, p4, p5, p6, p7, p8});

 curve = PolyCurve.ByPoints({p1, p2, p3, p4, p5, p6, p7, p8}, true);

 return = curve;

};
# ----------------------------------------
code_block_5 = CodeBlock()
# ---------- code_block_5.designscript (68 lines) ----------
//创建单卷杀长方体栱部分，
//cur->边界曲线
//width->长方体长度
//direction->延伸方向
def createCubiod(cur, width, direction)
{
 x1 = 0;
 y1 = 0;
 z1 = 0;
 x2 = 0;
 y2 = 0;
 z2 = 0;

 geometry = [Imperative]
 {
  if(direction == "x+")
  {
   x1 = cur.StartPoint.X + width;
   y1 = cur.StartPoint.Y;
   z1 = cur.StartPoint.Z;

   x2 = cur.EndPoint.X + width;
   y2 = cur.EndPoint.Y;
   z2 = cur.EndPoint.Z;
  }

  if(direction == "x-")
  {
   x1 = cur.StartPoint.X - width;
   y1 = cur.StartPoint.Y;
   z1 = cur.StartPoint.Z;

   x2 = cur.EndPoint.X - width;
   y2 = cur.EndPoint.Y;
   z2 = cur.EndPoint.Z;
  }

  if(direction == "y+")
  {
   x1 = cur.StartPoint.X;
   y1 = cur.StartPoint.Y + width;
   z1 = cur.StartPoint.Z;

   x2 = cur.EndPoint.X;
   y2 = cur.EndPoint.Y + width;
   z2 = cur.EndPoint.Z;
  }

  if(direction == "y-")
  {
   x1 = cur.StartPoint.X;
   y1 = cur.StartPoint.Y - width;
   z1 = cur.StartPoint.Z;

   x2 = cur.EndPoint.X;
   y2 = cur.EndPoint.Y - width;
   z2 = cur.EndPoint.Z;
  }
 }

 p1 = Point.ByCoordinates(x1, y1, z1);
 p2 = Point.ByCoordinates(x2, y2, z2);

 curve = PolyCurve.ByPoints({p1, p2}, false);

 return = curve;

};
# ----------------------------------------
code_block_6 = CodeBlock()
# ---------- code_block_6.designscript (14 lines) ----------
//获取创建枋类构件的中心点
//p_center->与坊正交的栱的长方体部分的质心
//p_down->栌枓的内角点
//dh->与坊正交的栱的高的一半
def getNDGFangCenterPoint(p_center, p_down, dh)
{
 x1 = 0;
 y1 = 0;
 z1 = p_down.Z + (p_center.Z + dh - p_down.Z) / 2;

 p1 = Point.ByCoordinates(x1, y1, z1);

 return = p1;
};
# ----------------------------------------
code_block_7 = CodeBlock()
# ---------- code_block_7.designscript (16 lines) ----------
//获取创建枋类构件的中心点
//p_center->与坊正交的栱的长方体部分的质心
//p_down->栌枓的内角点
//dh->与坊正交的栱的高的一半
def getHGFang(p, db, w, l, h)
{
 x1 = p.X + db - l / 2;
 y1 = p.Y - w / 2;
 z1 = p.Z + h / 2;

 p1 = Point.ByCoordinates(x1, y1, z1);

 cube = Cuboid.ByLengths(p1, l, w, h);

 return = cube;
};
# ----------------------------------------
code_block_8 = CodeBlock()
# ---------- code_block_8.designscript (10 lines) ----------
def getMidPoint(p1, p2, h1, dh, h)
{
 x1 = (p1.X + p2.X) / 2;
 y1 = (p1.Y + p2.Y) / 2;
 z1 = p1.Z + h1 + dh + h / 2;

 p_mid = Point.ByCoordinates(x1, y1, z1);

 return = p_mid;
};
# ----------------------------------------

code_block_9 = CodeBlock { Point.ByCoordinates(0, 0, 0); 10; }
centerPoint = CodeBlock { Point.ByCoordinates(0, 0, 0); }
b1_01 = DoubleSlider(100, range=80..130 step 5)
h1_01 = DoubleSlider(30, range=20..50 step 2)
b_01 = DoubleSlider(120, range=100..150 step 5)
b2_01 = DoubleSlider(40, range=20..50 step 2)
h_01 = DoubleSlider(80, range=60..100 step 2)
h2_01 = DoubleSlider(36, range=20..50 step 2)
m = DoubleInput(4)
b_02 = DoubleSlider(280, range=250..350 step 5)
b1_02 = DoubleSlider(60, range=50..80 step 2)
h1_02 = DoubleSlider(32, range=20..50 step 2)
h_02 = DoubleSlider(60, range=50..80 step 2)
code_block_10 = CodeBlock(centerPoint=centerPoint, b1_01=b1_01, h1_01=h1_01, b_01=b_01, b2_01=b2_01, h_01=h_01, h2_01=h2_01, m=m, b_02=b_02, b1_02=b1_02, h1_02=h1_02, h_02=h_02)
# ---------- code_block_10.designscript (2 lines) ----------
createFirst(centerPoint, b1_01, h1_01, b_01, b2_01, h_01, h2_01, m,
b_02, b1_02, h1_02, h_02);
# ----------------------------------------
watch = Watch(code_block_10)
code_block_11 = CodeBlock()
# ---------- code_block_11.designscript (20 lines) ----------
point;
r;

geometry = [Imperative]
{
 l = {};
 i = 5;
 while( i > 0 )
 {

  r = r + 1;
  l = List.AddItemToEnd(createQuadCenter(point, r), l);

  i = i - 1;

 }

 return = l;

};
# ----------------------------------------
b_12 = DoubleSlider(632, range=580..680 step 1)
r_16 = DoubleSlider(70, range=50..100 step 2)
b_15 = DoubleSlider(722, range=680..780 step 2)
l_14 = DoubleSlider(466, range=400..530 step 2)
b1_15 = DoubleSlider(90, range=70..120 step 2)
h_13 = DoubleSlider(60, range=50..80 step 2)
l_13 = DoubleSlider(568, range=500..620 step 2)
b1_04 = DoubleSlider(45, range=30..50 step 1)
h1_04 = DoubleSlider(17, range=5..30 step 1)
b_04 = DoubleSlider(70, range=50..100 step 5)
b2_04 = DoubleSlider(40, range=20..60 step 5)
h_04 = DoubleSlider(45, range=30..50 step 1)
h2_04 = DoubleSlider(18, range=5..30 step 1)
h2_05 = DoubleSlider(0, range=0..10 step 1)
b_06 = DoubleSlider(466, range=400..500 step 2)
h1_06 = DoubleSlider(32, range=20..50 step 2)
h_06 = DoubleSlider(60, range=50..80 step 2)
b2_08 = DoubleSlider(90, range=70..100 step 2)
b_07 = DoubleSlider(220, range=180..300 step 5)
b_10 = DoubleSlider(413, range=350..450 step 1)
h1_10 = DoubleSlider(32, range=20..50 step 2)
b2_12 = DoubleSlider(90, range=70..100 step 2)
h_09 = DoubleSlider(60, range=50..80 step 2)
b_09 = DoubleSlider(568, range=500..620 step 2)
b_11 = DoubleSlider(256, range=200..300 step 2)
h_16 = DoubleSlider(377, range=300..420 step 1)
code_block_12 = CodeBlock()
# ---------- code_block_12.designscript (228 lines) ----------
//create first tiao
//p->centerpoint


def createFirst(centerPoint, b1_01, h1_01, b_01, b2_01, h_01, h2_01, m,
b_02, b1_02, h1_02, h_02)
{
 result = {};
 /*****create quad****/
 //centerpoint
 p = centerPoint;
 //radius
 r = b1_01 / 2;
 //create Trape -- d
 T_d = (b_01 - b1_01) / 2;
 //create U Plane -- h1
 U_h1 = h_01 - h1_01;
 //create JuanSha -- u
 JS_u = h2_01 / U_h1;
 //create JuanSha -- v
 JS_v = b2_01 / b_01;
 //create JuanSha -- 1 - v
 JS_mv = 1 - (b2_01 / b_01);
 //create JuanSha -- b2
 JS_b2 = ((b_02 - 2 * b1_02) - b_01) / 2;
 //bottom quad
 bottomQuad = createQuadCenter(centerPoint, r);

 bottomQuadSurface = Surface.ByPatch(bottomQuad);

 result = List.AddItemToEnd(bottomQuadSurface, result);
 /****create trape*****/
 //trape1
 p_T1 = Surface.PointAtParameter(bottomQuadSurface, 0.5, 0);

 direc1 = "y-";
 Trape1 = createTrape(p_T1, b1_01, b_01, h1_01, T_d, direc1);

 Trape1_S = Surface.ByPatch(Trape1);

 result = List.AddItemToEnd(Trape1_S, result);

 //trape2
 p_T2 = Surface.PointAtParameter(bottomQuadSurface, 0.5, 1);

 direc2 = "y+";
 Trape2 = createTrape(p_T2, b1_01, b_01, h1_01, T_d, direc2);

 Trape2_S = Surface.ByPatch(Trape2);

 result = List.AddItemToEnd(Trape2_S, result);

 //trape3
 p_T3 = Surface.PointAtParameter(bottomQuadSurface, 1, 0.5);

 direc3 = "x+";
 Trape3 = createTrape(p_T3, b1_01, b_01, h1_01, T_d, direc3);

 Trape3_S = Surface.ByPatch(Trape3);

 result = List.AddItemToEnd(Trape3_S, result);

 //trape4
 p_T4 = Surface.PointAtParameter(bottomQuadSurface, 0, 0.5);

 direc4 = "x-";
 Trape4 = createTrape(p_T4, b1_01, b_01, h1_01, T_d, direc4);

 Trape4_S = Surface.ByPatch(Trape4);

 result = List.AddItemToEnd(Trape4_S, result);

 /*****create U plane*****/
 //UPlane1
 p_U1 = Surface.PointAtParameter(Trape1_S, 0, 0.5);

 direc12 = "x";
 UPlane1 = createUPlane(p_U1, b_01, b2_01, U_h1, h2_01, direc12);

 UPlane1_S = Surface.ByPatch(UPlane1);

 result = List.AddItemToEnd(UPlane1_S, result);

 //UPlane2
 p_U2 = Surface.PointAtParameter(Trape2_S, 0, 0.5);


 UPlane2 = createUPlane(p_U2, b_01, b2_01, U_h1, h2_01, direc12);

 UPlane2_S = Surface.ByPatch(UPlane2);

 result = List.AddItemToEnd(UPlane2_S, result);

 //UPlane3
 p_U3 = Surface.PointAtParameter(Trape3_S, 0, 0.5);

 direc34 = "y";
 UPlane3 = createUPlane(p_U3, b_01, b2_01, U_h1, h2_01, direc34);

 UPlane3_S = Surface.ByPatch(UPlane3);

 result = List.AddItemToEnd(UPlane3_S, result);

 //UPlane4
 p_U4 = Surface.PointAtParameter(Trape4_S, 0, 0.5);


 UPlane4 = createUPlane(p_U4, b_01, b2_01, U_h1, h2_01, direc34);

 UPlane4_S = Surface.ByPatch(UPlane4);

 result = List.AddItemToEnd(UPlane4_S, result);

 /*****create JuanSha*****/
 //JS1
 direc1 = "y-";
 //JS1_1
 p_JS1_1 = Surface.PointAtParameter(UPlane1_S, JS_u, JS_v);

 JS1_1 = createJuanshaCurve(p_JS1_1, b1_02, JS_b2, m, h1_02, h_02, direc1);

 JS1_C1 = Surface.ByPatch(JS1_1);

 result = List.AddItemToEnd(JS1_C1, result);

 //JS1_2
 p_JS1_2 = Surface.PointAtParameter(UPlane1_S, JS_u, JS_mv);

 JS1_2 = createJuanshaCurve(p_JS1_2, b1_02, JS_b2, m, h1_02, h_02, direc1);

 JS1_C2 = Surface.ByPatch(JS1_2);

 result = List.AddItemToEnd(JS1_C2, result);

 JS1 = {};

 JS1 = List.AddItemToEnd(JS1_1, JS1);
 JS1 = List.AddItemToEnd(JS1_2, JS1);
 JS1_S = Surface.ByLoft(JS1);

 result = List.AddItemToEnd(JS1_S, result);

 //JS2
 direc2 = "y+";
 //JS2_1
 p_JS2_1 = Surface.PointAtParameter(UPlane2_S, JS_u, JS_v);

 JS2_1 = createJuanshaCurve(p_JS2_1, b1_02, JS_b2, m, h1_02, h_02, direc2);

 JS2_C1 = Surface.ByPatch(JS2_1);

 result = List.AddItemToEnd(JS2_C1, result);

 //JS2_2
 p_JS2_2 = Surface.PointAtParameter(UPlane2_S, JS_u, JS_mv);

 JS2_2 = createJuanshaCurve(p_JS2_2, b1_02, JS_b2, m, h1_02, h_02, direc2);

 JS2_C2 = Surface.ByPatch(JS2_2);

 result = List.AddItemToEnd(JS2_C2, result);

 JS2 = {};

 JS2 = List.AddItemToEnd(JS2_1, JS2);
 JS2 = List.AddItemToEnd(JS2_2, JS2);
 JS2_S = Surface.ByLoft(JS2);

 result = List.AddItemToEnd(JS2_S, result);

 //JS3
 direc3 = "x+";
 //JS3_1
 p_JS3_1 = Surface.PointAtParameter(UPlane3_S, JS_u, JS_v);

 JS3_1 = createJuanshaCurve(p_JS3_1, b1_02, JS_b2, m, h1_02, h_02, direc3);

 JS3_C1 = Surface.ByPatch(JS3_1);

 result = List.AddItemToEnd(JS3_C1, result);

 //JS3_2
 p_JS3_2 = Surface.PointAtParameter(UPlane3_S, JS_u, JS_mv);

 JS3_2 = createJuanshaCurve(p_JS3_2, b1_02, JS_b2, m, h1_02, h_02, direc3);

 JS3_C2 = Surface.ByPatch(JS3_2);

 result = List.AddItemToEnd(JS3_C2, result);

 JS3 = {};

 JS3 = List.AddItemToEnd(JS3_1, JS3);
 JS3 = List.AddItemToEnd(JS3_2, JS3);
 JS3_S = Surface.ByLoft(JS3);

 result = List.AddItemToEnd(JS3_S, result);

 //JS4
 direc4 = "x-";
 //JS4_1
 p_JS4_1 = Surface.PointAtParameter(UPlane4_S, JS_u, JS_v);

 JS4_1 = createJuanshaCurve(p_JS4_1, b1_02, JS_b2, m, h1_02, h_02, direc4);

 JS4_C1 = Surface.ByPatch(JS4_1);

 result = List.AddItemToEnd(JS4_C1, result);

 //JS4_2
 p_JS4_2 = Surface.PointAtParameter(UPlane4_S, JS_u, JS_mv);

 JS4_2 = createJuanshaCurve(p_JS4_2, b1_02, JS_b2, m, h1_02, h_02, direc4);

 JS4_C2 = Surface.ByPatch(JS4_2);

 result = List.AddItemToEnd(JS4_C2, result);

 JS4 = {};

 JS4 = List.AddItemToEnd(JS4_1, JS4);
 JS4 = List.AddItemToEnd(JS4_2, JS4);
 JS4_S = Surface.ByLoft(JS4);

 result = List.AddItemToEnd(JS4_S, result);

 return = result;
};
# ----------------------------------------
